# Grasshopper definition export_from_karamba.gh (Grasshopper 1.0.7)
# plug-ins: LunchBox, karambaGH

curve = Curve([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])

# ---- group: Reference Geometry
# to apply to a new model:
# right-click and set multiple curves;
# 
# ** pay close attention to intersections of rhino curves;
# Karamba3D will not read joints if lines are not intersecting
curve_2 = Curve([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])
explode = Explode(Curve=curve, Recursive=True)  # -> flatten(Segments), Vertices
# 01 Input Curves As Truss
# Difficulty: Simple
# This definition takes curve input from rhino, converts them to beams and measures performance under loading conditions
# 
# Steps to alter:
# 1. change slider that controls loads: notice the behavior of the hinge and roller supports as truss deflects
# 2. toggle the "modify element" component to change beams to axial-only loads; hinged joints
# 3. turn control points on in rhino to adjust the geometry of the truss
line_line_intersection_karamba3d = LineLineIntersectionKaramba(Line=explode.Segments, LengthTolerance=0.01)  # -> IntersectionPoints, flatten(LineSubSegements)

# ----
list_item = ListItem(List=curve, Index=0, Wrap=True)  # -> Item1, Item

# ---- group: Reference Geometry
# to apply to a new model:
# right-click and set multiple points;
# 
# ** points must be near intended supports;
# definition will automatically snap to closest node in model
point = Point([Point(7.338080932, 0.3633907323, 5.215597679), Point(-0.09269640327, 0.3633907323, 6.072995064), Point(-7.523473739, 0.3633907323, 4.882165363)])

# ----
point_2 = Point(Point(-0.09269640327, 0.3633907323, 6.072995064))

# ---- group: Reference Geometry
# to apply to a new model:
# right-click and set multiple points;
# 
# ** points must be near intended supports;
# definition will automatically snap to closest node in model
point_3 = Point(Point(-11.8471691, 0.3633907323, -0.4490884826))

# to apply to a new model:
# right-click and set multiple points;
# 
# ** points must be near intended supports;
# definition will automatically snap to closest node in model
point_4 = Point(Point(11.11202754, 0.3633907323, -0.7348876109))

# ----
number_slider = Slider(4, range=0..10)
curve_3 = Curve(list_item.Item)
curve_4 = Curve(list_item.Item1)
panel = Panel("6")
random_split_list = RandomSplitList(MasterList=line_line_intersection_karamba3d.LineSubSegements, Seed=number_slider, Split=0.5)  # -> ListA, ListB
split_list = SplitList(List=line_line_intersection_karamba3d.LineSubSegements, Index=number_slider)  # -> ListA, ListB
live_load = Slider(-10, range=-50..-0.04)
c_script = CSharpScript(Reference=["D:\CODE_WS\PB_WS\CONMECH\EXAMPLES\GH_SCRIPTS\KARAMBA\Newtonsoft.Json.dll", "C:\Program Files\Rhino 6\Plug-ins\karambaCommon.dll", "C:\Program Files\Rhino 6\Plug-ins\karamba.gha"])  # -> out, A; inputs toggle: Boolean, file_path: String, model_name: String, model_type: String, assembly_type: String, unit: String, dimension: Int32, relative_pos_to_robot_base: Plane, node_pts: list of Point3d, ground_nodes_identifier: list of Int32, fixities: tree of Int32, elements: tree of Int32, material_name: String, youngs_modulus: Double, youngs_modulus_unit: String, shear_modulus: Double, shear_modulus_unit: String, tensile_yeild_stress: Double, tensile_yeild_stress_unit: String, poisson_ratio: Double, radius: Double, radius_unit: String, density: Double, density_unit: String, is_uniform_cross_sec: Boolean, is_uniform_mat: Boolean; disabled
# ---------- c_script: C# usings ----------
using System.IO;
using System.Linq;
using System.Data;
using System.Drawing;
using System.Reflection;
using System.Windows.Forms;
using System.Xml;
using System.Xml.Linq;
using System.Runtime.InteropServices;

using Rhino.DocObjects;
using Rhino.Collections;
using GH_IO;
using GH_IO.Serialization;
using Newtonsoft.Json;
using Newtonsoft.Json.Serialization;
using Newtonsoft.Json.Schema;
using Newtonsoft.Json.Linq;
using Newtonsoft.Json.Converters;
using Newtonsoft.Json.Bson;
# ---------- c_script: C# ----------
    if(toggle == false)
    {
      return;
    }

    JsonSerializer serializer = new JsonSerializer();
    serializer.NullValueHandling = NullValueHandling.Ignore;
    serializer.Formatting = Newtonsoft.Json.Formatting.Indented;

    // init assembly sequence obj, wire in global params
    ChoreoInputModel cas = new ChoreoInputModel();
    cas.model_name = model_name;
    cas.assembly_type = assembly_type;
    cas.model_type = model_type;
    cas.generate_time = DateTime.Now.ToString();
    cas.unit = unit;
    cas.dimension = dimension;
    cas.element_num = elements.BranchCount;
    cas.node_num = node_pts.Count();

    cas.base_frame_in_rob_base = relative_pos_to_robot_base;

    cas.uniform_cross_section = is_uniform_cross_sec;
    cas.uniform_material_properties = is_uniform_mat;
    cas.material_properties = new MaterialProperty();
    cas.material_properties.material_name = material_name;
    cas.material_properties.youngs_modulus = youngs_modulus;
    cas.material_properties.youngs_modulus_unit = youngs_modulus_unit;

    cas.material_properties.shear_modulus = shear_modulus;
    cas.material_properties.shear_modulus_unit = shear_modulus_unit;

    cas.material_properties.tensile_yeild_stress = tensile_yeild_stress;
    cas.material_properties.tensile_yeild_stress_unit = tensile_yeild_stress_unit;

    cas.material_properties.poisson_ratio = poisson_ratio;

    cas.material_properties.density = density;
    cas.material_properties.density_unit = density_unit;

    cas.material_properties.cross_sec_area = radius * radius * Math.PI;
    cas.material_properties.cross_sec_area_unit = "centimeter^2";
    cas.material_properties._cross_sec_area_note = "round_shape, pi * r^2";

    cas.material_properties.Jx = 0.5 * Math.Pow(radius, 4) * Math.PI;
    cas.material_properties.Jx_unit = "centimeter^4";
    cas.material_properties._Jx_note = "0.5 * pi * r^4";

    cas.material_properties.Iy = 0.25 * Math.Pow(radius, 4) * Math.PI;
    cas.material_properties.Iy_unit = "centimeter^4";
    cas.material_properties._Iy_note = "0.25 * pi * r^4";

    cas.material_properties.Iz = 0.25 * Math.Pow(radius, 4) * Math.PI;
    cas.material_properties.Iz_unit = "centimeter^4";
    cas.material_properties._Iz_note = "0.25 * pi * r^4";

    cas.node_list = new List<FrameNode>(node_pts.Count());
    cas.element_list = new List<FrameElement>(elements.BranchCount);

    // create nodes
    for(int i = 0; i < node_pts.Count(); i++)
    {
      FrameNode nd = new FrameNode();
      nd.point = node_pts[i];
      nd.node_id = i;
      nd.is_grounded = ground_nodes_identifier[i];
      nd.fixities = fixities.Branch(i);

      cas.node_list.Add(nd);
    }

    // create each sequenced element
    for(int i = 0; i < elements.BranchCount; i++)
    {
      FrameElement ne = new FrameElement();
      ne.end_node_ids = new List<int>();
      ne.element_id = i;
      ne.end_node_ids = elements.Branch(i);

      cas.element_list.Add(ne);
    }

    // GH screen output
    //    string json = JsonConvert.SerializeObject(cas, Newtonsoft.Json.Formatting.Indented);
    //    Print(json);

    // serialize to json file
    using (StreamWriter sw = new StreamWriter(@file_path))
    using (JsonWriter writer = new JsonTextWriter(sw))
    {
      serializer.Serialize(writer, cas);
    }
# ---------- c_script: C# additional code ----------
  public class FrameNode
  {
    public Point3d point { get; set; }
    public int node_id { get; set; }
    public int is_grounded { get; set; }
    public List<int> fixities { get; set; }
  }

  public class FrameElement
  {
    public List<int> end_node_ids { get; set; }
    public int element_id { get; set; }
    public int layer_id { get; set; }
  }

  public class MaterialProperty
  {
    public string material_name { get; set; }
    public string _source { get; set; }
    public double youngs_modulus { get; set; }
    public string youngs_modulus_unit { get; set; }

    public double shear_modulus { get; set; }
    public string shear_modulus_unit { get; set; }

    public double tensile_yeild_stress { get; set; }
    public string tensile_yeild_stress_unit { get; set; }

    public double density { get; set; }
    public string density_unit { get; set; }

    public double poisson_ratio { get; set; }

    //    public double radius { get; set; }
    //    public string radius_unit { get; set; }
    public double cross_sec_area { get; set; }
    public string cross_sec_area_unit { get; set; }
    public string _cross_sec_area_note { get; set; }

    public double Jx { get; set; }
    public string Jx_unit { get; set; }
    public string _Jx_note { get; set; }

    public double Iy { get; set; }
    public string Iy_unit { get; set; }
    public string _Iy_note { get; set; }

    public double Iz { get; set; }
    public string Iz_unit { get; set; }
    public string _Iz_note { get; set; }
  }

  public class ChoreoInputModel
  {
    public string model_name { get; set; }
    public string assembly_type { get; set; }
    public string model_type { get; set; }
    public string unit { get; set; }
    public string generate_time { get; set; }

    public int dimension { get; set; }
    public int node_num { get; set; }
    public int element_num { get; set; }

    public Plane base_frame_in_rob_base { get; set; }

    public bool uniform_cross_section { get; set; }
    public bool uniform_material_properties { get; set; }
    public MaterialProperty material_properties { get; set; }

    public List<FrameNode> node_list { get; set; }
    public List<FrameElement> element_list { get; set; }
  }
# ---------- end c_script ----------
unit_y = UnitY(Factor=live_load)

# ---- group: Define Elements
# This work is licensed under a Creative Commons Attribution 4.0 licence. You are free to copy, communicate and adapt the work, so long as you attribute the work in the manner specified by the author or licensor (but not in any way that suggests that they endorse you or your use of the work). A copy of this licence is available at http://http://creativecommons.org/licenses/by/4.0/ or write to info@creativecommons.org
# an ideal truss has hinged joints and
#  members carry only axial loads
boolean_toggle = BooleanToggle(False)  # disabled
panel_2 = Panel("beams")  # disabled
line_to_beam_karamba3d = LineToBeamKaramba3D(
    Line=line_line_intersection_karamba3d.LineSubSegements,
    Identifier=panel_2,
    New=True,
    Remove=True,
    LimitDistance_m=0.005,
    Bending=boolean_toggle)  # -> Element, Points, Info; disabled

# ----
cross_section_karamba3d = CrossSectionKaramba3D(
    FamilyNameOfCrossSection="DefaultCroSec",
    Material=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,
    Height_cm=9.6,
    UpperFlangeWidth_cm=10,
    LowerFlangeWidth_cm=10,
    UpperFlangeThickness_cm=0.8,
    LowerFlangeThickness_cm=0.8,
    WebThickness_cm=0.5,
    FilletRadius_cm=0,
    mode="I")
point_5 = Point([Point(-10, 0, 0), Point(0, 0, 5), Point(10, 0, 0)])

# ---- group: get model xml
c_script_2 = CSharpScript(Reference=["C:\Program Files\Rhino 6\Plug-ins\karambaCommon.dll", "C:\Program Files\Rhino 6\Plug-ins\karamba.gha"])  # -> out, XML; disabled
# ---------- c_script_2: C# usings ----------
using System.Xml;
using System.IO;
using Karamba.Models;
using Karamba.Nodes;
using Karamba.CrossSections;
using Karamba.Elements;
using Karamba.Loads;
using Karamba.Materials;
using Karamba.Supports;
using Karamba.Geometry;
# ---------- c_script_2: C# ----------
    var model = Model_in as Model;
    if (model == null) {
      throw new ArgumentException("The input is not of type model!");
    }

    var builder = new BuilderXML();
    var director = new Karamba.Exporters.ExportDirector();
    director.ConstructExport(model, builder);

    XML = builder.getProduct();
# ---------- c_script_2: C# additional code ----------
  public class BuilderXML : Karamba.Exporters.ExportBuilder {
    // the XML document
    private XmlDocument doc_ = new XmlDocument();
    // the model inside the xml-document
    private XmlElement model_;

    public override void newProduct() {
      model_ = (XmlElement) doc_.AppendChild(doc_.CreateElement("K3DModel"));
    }

    public override void buildMaterial(FemMaterial m, int ind) {
      var xml_node = (XmlElement) model_.AppendChild(doc_.CreateElement("FemMaterial"));
      xml_node.InnerText = "ind: " + ind + ":" + m.ToString();
    }

    public override void buildVertex(Node v) {
      var xml_node = (XmlElement) model_.AppendChild(doc_.CreateElement("Node"));
      xml_node.InnerText = v.ToString();
    }

    public override void buildCroSec(CroSec crosec) {
      var xml_node = (XmlElement) model_.AppendChild(doc_.CreateElement("CroSec"));
      xml_node.InnerText = crosec.ToString();
    }

    public override void buildElement(ModelElement e, Model model) {
      var xml_node = (XmlElement) model_.AppendChild(doc_.CreateElement("ModelElement"));
      xml_node.InnerText = e.ToString();
    }

    public override void buildElementLoad(ModelElement elem, Model model) {
      foreach (var l in elem.Elem_loads) {
        var xml_node = (XmlElement) model_.AppendChild(doc_.CreateElement("ElementLoad"));
        xml_node.InnerText = l.ToString();
      }
    }

    public override void buildLoadCase(int lc_ind, Model model) {
      Vector3 g_vec = new Vector3(0, 0, 0);
      foreach (GravityLoad g in model.gravities.Values) {
        if (g.loadcase < 0 || g.loadcase == lc_ind) {
          g_vec = g.force;
          };
      }

      var xml_node = (XmlElement) model_.AppendChild(doc_.CreateElement("LoadCase"));
      xml_node.InnerText = "load-case: " + lc_ind + " g =" + g_vec;

    }

    public override void buildSupport(Support s) {
      var xml_node = (XmlElement) model_.AppendChild(doc_.CreateElement("Support"));
      xml_node.InnerText = s.ToString();
    }

    public override void buildPointLoad(PointLoad p) {
      var xml_node = (XmlElement) model_.AppendChild(doc_.CreateElement("PointLoad"));
      xml_node.InnerText = p.ToString();
    }

    public override void buildMeshLoad(MeshLoad m) {
      var xml_node = (XmlElement) model_.AppendChild(doc_.CreateElement("MeshLoad"));
      xml_node.InnerText = m.ToString();
    }

    public string getProduct() {
      StringWriter sw = new StringWriter();
      XmlTextWriter tx = new XmlTextWriter(sw);
      doc_.WriteTo(tx);
      string str = sw.ToString();//
      return str;
    }
  }
# ---------- end c_script_2 ----------

# ---- group: get material example
hello_k3d = CSharpScript(Reference=["C:\Program Files\Rhino 6\Plug-ins\karambaCommon.dll", "C:\Program Files\Rhino 6\Plug-ins\karamba.gha"])  # -> out; disabled
# ---------- hello_k3d: C# usings ----------
using Karamba.Models;
using Karamba.Utilities;
using Karamba.Materials;
# ---------- hello_k3d: C# ----------
    var model = Model_in as Model;
    if (model == null) {
      throw new ArgumentException("The input is not of type Karamba.Models.Model!");
    }

    var matWeights = new Dictionary<FemMaterial, double>();

    foreach (var elem in model.elems) {
      var mat = elem.crosec.material;
      if (!matWeights.ContainsKey(mat)){
        matWeights[mat] = 0;
      }
      matWeights[mat] += elem.weight(model.nodes);
    }

    var ucf = UnitsConversionFactories.Conv();
    var kg = ucf.weight2kg();
    
    foreach (var entry in matWeights) {
      Print("Material: " + entry.Key.name + ": " + kg.toBase(entry.Value) + kg.unitB);
    }
# ---------- end hello_k3d ----------

# ----
element_karamba3d = ElementKaramba3D(line_to_beam_karamba3d.Element)
point_6 = Point(point_5)

# ---- group: Define Loads
# live load applied as uniform distributed (mesh) loads
# ** note: low mesh density can
# result in uneven distribution of load
# LIVE LOAD REFERENCE:
# ref: The Structural Basis of Architecture, Sandaker et al.
# residential (typical) 	2 kN/m2  	.04 kip/ft2
# office (tyipcal)  			3 kN/m2  	.06 kip/ft2
# public plazas  	12 kN/m2  	.25 kip/ft2
# athletic facilities (typical)  5 kN/m2  	.1 kip/ft2
# hospitals (operating rooms)  3 kN/m2   .06 kip/ft2
# libraries (book stacks)  7 kN/m2   .15 kip/ft2
# manufacturing (typical)  6 kN/m2   .125 kip/ft2
# heavy equipment   12 kN/m2   .25 kip/ft2
# schools (classrooms)   2 kN/m2   .04 kip/ft2
# schools (hallways)   5 kN/m2   .1 kip/ft2
live_load_2 = Slider(-10, range=-50..-0.04)
unit_z = UnitZ(Factor=live_load_2)
find_similar_member = FindSimilarMember(Data=point, Set=point_6)  # -> Hit, Index
unit_z_2 = UnitZ(Factor="-1")
loads_karamba3d = LoadsKaramba3D(Vector=unit_z_2, LCase=0, mode="Gravity")
loads_karamba3d_2 = LoadsKaramba3D(ForceVector=unit_z, Local=False, PosInd=find_similar_member.Hit, LCase=0, mode="Point")
load_karamba3d = LoadKaramba3D(flatten(loads_karamba3d_2))

# ---- group: Define Supports
# ROLLER support can translate in the x
# direction and rotate about the y axis
# PIN support cannot translate in any
# direction but  can rotate about the y axis
# out of plane support for all nodes:
# restrain all nodes out of plane for
# 2d analysis
find_similar_member_2 = FindSimilarMember(Data=point_4, Set=point_6)  # -> Hit, Index
find_similar_member_3 = FindSimilarMember(Data=point_3, Set=point_6)  # -> Hit, Index
cull_index = CullIndex(List=point_6, Indices=[find_similar_member_2.Index, find_similar_member_3.Index], Wrap=True)
support_karamba3d = SupportKaramba(PosInd=cull_index, menu=[buttons(off, on, off, on, off, on)])
support_karamba3d_2 = SupportKaramba(PosInd=find_similar_member_2.Hit, menu=[buttons(on, on, on, on, on, on)])
support_karamba3d_3 = SupportKaramba(PosInd=find_similar_member_3.Hit, menu=[buttons(on, on, on, on, on, on)])
support_karamba3d_4 = SupportKaramba(flatten([support_karamba3d_2, support_karamba3d, support_karamba3d_3]))
support_karamba3d_5 = SupportKaramba(flatten([support_karamba3d_3, support_karamba3d_2]))

# ----
loads_karamba3d_3 = LoadsKaramba3D(ForceVector=unit_z, Local=False, PosInd=find_similar_member.Hit, LCase=0, mode="Point")
loads_karamba3d_4 = LoadsKaramba3D(Vector=unit_z_2, LCase=0, mode="Uniform Line", menu=[buttons(off, on, off)])
panel_3 = Panel(loads_karamba3d_4)

beam_truss_bending = BooleanToggle(True)
beam_bending = BooleanToggle(True)
has_joint = BooleanToggle(False)

# ---- group: Define Elements
# an ideal truss has hinged joints and
#  members carry only axial loads
panel_4 = Panel("beams_truss")
line_to_beam_karamba3d_2 = LineToBeamKaramba3D(
    Line=curve_4,
    Identifier=panel_4,
    CrossSection=cross_section_karamba3d,
    New=True,
    Remove=True,
    LimitDistance_m=0.005,
    Bending=beam_truss_bending)  # -> Element, Points, Info

# an ideal truss has hinged joints and
#  members carry only axial loads
panel_5 = Panel("beams")
line_to_beam_karamba3d_3 = LineToBeamKaramba3D(
    Line=curve_3,
    Identifier=panel_5,
    CrossSection=cross_section_karamba3d,
    New=True,
    Remove=True,
    LimitDistance_m=0.005,
    Bending=beam_bending)  # -> Element, Points, Info

# ----
panel_6 = Panel(line_to_beam_karamba3d_3.Points)
panel_7 = Panel(line_to_beam_karamba3d_2.Points)
panel_8 = Panel(load_karamba3d)
merge = Merge(Data1=line_to_beam_karamba3d_3.Element, Data2=line_to_beam_karamba3d_2.Element)

# ---- group: supports marked as grounded, to differentiate from "2D-stablizing" supports
support_karamba3d_6 = SupportKaramba(flatten(support_karamba3d_5))

# ----
rhino_doc_dir = RhinoDocDir()  # -> rhino_doc_dir
# ---------- rhino_doc_dir: Python ----------
import scriptcontext as sc
from os import path

rhino_doc_dir = path.abspath(path.dirname(sc.doc.Path))
# ---------- end rhino_doc_dir ----------
construct_point = ConstructPoint(XCoordinate="0", YCoordinate=Slider(0, range=0..2), ZCoordinate="0")
construct_point_2 = ConstructPoint(XCoordinate="0", YCoordinate=Slider(0, range=0..2), ZCoordinate="0")
format_json = BooleanToggle(True)
export_json = BooleanToggle(False)
ghpython_script = GhPythonScript(x=rhino_doc_dir)  # -> a
# ---------- ghpython_script: Python ----------
import os

a = os.path.join(x, '..', '..', '..', 'tests', 'test_data')
# ---------- end ghpython_script ----------
beam_joints_karamba3d = BeamJointsKaramba3D(
    ElementIdentifiers=panel_4,
    CtKNMAtStartingNode=Vector(0, 0, 0),
    CrKNmRadAtStartingNode=construct_point,
    CtKNMAtEndNode=Vector(0, 0, 0),
    CrKNmRadAtEndNode=construct_point,
    menu=[buttons(off, off, off, off, off, off), buttons(off, off, off, off, off, off)])
beam_joints_karamba3d_2 = BeamJointsKaramba3D(
    ElementIdentifiers=panel_5,
    CtKNMAtStartingNode=Vector(0, 0, 0),
    CrKNmRadAtStartingNode=construct_point_2,
    CtKNMAtEndNode=Vector(0, 0, 0),
    CrKNmRadAtEndNode=construct_point_2,
    menu=[buttons(off, off, off, off, off, off), buttons(off, off, off, off, on, off)])
stream_filter = StreamFilter(Gate=has_joint, Stream1=[beam_joints_karamba3d, beam_joints_karamba3d_2])

# ---- group: Assemble Model
assemble_model_karamba3d = AssembleModelKaramba(Point=point_5, Elem=merge, Support=support_karamba3d_4, Load=load_karamba3d, Joint=stream_filter, LimitDistance_m=0.005)  # -> Model, Info, Mass_kg, CenterOfGravity

# ----
model_karamba3d = ModelKaramba3D(assemble_model_karamba3d.Model)

# ---- group: convert a karamba model into conmech format and export
c_script_3 = CSharpScript(
    k_model=model_karamba3d,
    k_grounded_nodes=support_karamba3d_6,
    model_name="2D_truss",
    save_path=ghpython_script,
    export=export_json,
    format_json=format_json,
    Reference=["C:\Program Files\Rhino 6\Plug-ins\karambaCommon.dll", "C:\Program Files\Rhino 6\Plug-ins\karamba.gha", "D:\CODE_WS\PB_WS\CONMECH\EXAMPLES\GH_SCRIPTS\KARAMBA\Newtonsoft.Json.dll"])  # -> out, A; inputs k_grounded_nodes: list, model_name: String, save_path: String, export: Boolean, limit_distance: Double, format_json: Boolean
# ---------- c_script_3: C# usings ----------
using System.IO;
using Karamba.Models;
using Karamba.Nodes;
using Karamba.CrossSections;
using Karamba.Elements;
using Karamba.Loads;
using Karamba.Materials;
using Karamba.Supports;
using Karamba.Geometry;
using Karamba.Joints;
using Newtonsoft.Json;
# ---------- c_script_3: C# ----------
    var k_model = _k_model as Model;
    if (k_model == null) {
      throw new ArgumentException("The input is not of type karamba model!");
    }
    if (limit_distance == 0) {
      limit_distance = 0.005; // meter
    }

    // initiate nodes with id and position
    var c_nodes = k_model.nodes.ConvertAll(kn => new ConmechFrameNode(kn));

    // support fixities & gounded node tags
    var k_grounded = _k_grounded_nodes.ConvertAll(x => x as Support);

    // tag grounded
    foreach(Support k_supp in k_model.supports) {
      foreach(Support k_g in k_grounded) {
        if (k_g == null) {
          throw new ArgumentException("The input is not of type karamba support!");
        }
        if(k_supp.position.DistanceTo(k_g.position) < limit_distance) {
          c_nodes[k_supp.node_ind].is_grounded = true;
        }
      }
    }

    // element data
    var c_elements = k_model.elems.ConvertAll(ke => new ConmechFrameElement(ke as ModelTruss));

    // support data
    var c_supports = k_model.supports.ConvertAll(ks => new ConmechSupport(ks as Support));

    // material data
    var c_mats = k_model.materials.ConvertAll(km => new ConmechFemMaterial(km));

    // cross section data
    var c_crosecs = k_model.crosecs.ConvertAll(kc => new ConmechCrossSec(kc as CroSec_Beam));

    // load data
    var c_ploads = k_model.ploads.ConvertAll(kl => new ConmechPointLoad(kl as PointLoad));
    var c_eloads = k_model.eloads.ConvertAll(kl => new ConmechUnifDistLoad(kl as UniformlyDistLoad));
    GravityLoad k_grav;
    ConmechGravityLoad c_grav = null;
    k_model.gravities.TryGetValue(0, out k_grav);
    if(k_grav != null){
      c_grav = new ConmechGravityLoad(k_grav);
    }

    // joint data
    var c_joints = k_model.joints.ConvertAll(kj => new ConmechJoint(kj));

    var c_model = new ConmechModel();
    c_model.model_name = model_name;
    c_model.generate_time = DateTime.Now.ToString();
    c_model.unit = "meter";
    c_model.element_num = k_model.elems.Count;
    c_model.node_num = k_model.nodes.Count;

    c_model.nodes = c_nodes;
    c_model.elements = c_elements;
    c_model.joints = c_joints;
    c_model.supports = c_supports;

    c_model.cross_secs = c_crosecs;
    c_model.materials = c_mats;

    var c_loadcase = new ConmechLoadCase();
    c_loadcase.ploads = c_ploads;
    c_loadcase.eloads = c_eloads;
    if(c_grav != null){
      c_loadcase.gravity = c_grav;
    }

    // save to json
    if(export) {
      JsonSerializer serializer = new JsonSerializer();
      serializer.NullValueHandling = NullValueHandling.Ignore;
      if(format_json) {
        serializer.Formatting = Newtonsoft.Json.Formatting.Indented;
      }
      // serialize shape to a json file
      string shape_file_path = String.Concat(save_path, Path.DirectorySeparatorChar,
        model_name, ".json");
      using (StreamWriter sw = new StreamWriter(@shape_file_path))
      using (JsonWriter writer = new JsonTextWriter(sw))
      {
        serializer.Serialize(writer, c_model);
      }
      Print("Shape saved to {0}", shape_file_path);

      // serialize load case to a json file
      string load_file_path = String.Concat(save_path, Path.DirectorySeparatorChar,
        model_name, "_loads.json");
      using (StreamWriter sw = new StreamWriter(@load_file_path))
      using (JsonWriter writer = new JsonTextWriter(sw))
      {
        serializer.Serialize(writer, c_loadcase);
      }
      Print("Load saved to {0}", load_file_path);
    }
# ---------- c_script_3: C# additional code ----------
  // TODO compile these into a dll
  //  public class cPoint3
  //  {
  //    public cPoint3(Point3 p) {
  //      X = p.X; Y = p.Y; Z = p.Z;
  //    }
  //    public cPoint3(Vector3 p) {
  //      X = p.X; Y = p.Y; Z = p.Z;
  //    }
  //    public double X { get; set; }
  //    public double Y { get; set; }
  //    public double Z { get; set; }
  //  }


  public class ConmechFrameNode
  {
    public ConmechFrameNode(Node k_node) {
      node_ind = -1;
      is_grounded = false;
      node_ind = k_node.ind;
      point = new List<double>(){k_node.pos.X, k_node.pos.Y, k_node.pos.Z};
    }
    public List<double> point { get; set; }
    public int node_ind { get; set; }
    // is_grounded marks if the node is a support node
    // used to differentiate the supports to make a 2D structure stable
    public bool is_grounded { get; set; }
  }

  public class ConmechFrameElement
  {
    public ConmechFrameElement(ModelTruss ke) {
      elem_tag = ke.id;
      elem_ind = ke.ind;
      end_node_inds = ke.node_inds as List<int>;
      bending_stiff = ke.bending_stiff;
      // default layer index
      layer_ind = -1;
    }
    public List<int> end_node_inds { get; set; }
    // element identifier
    public string elem_tag { get; set; }
    // zero-based index of element in model
    public int elem_ind { get; set; }
    // an extra tag identify for grouping elements, can be used in sequencing
    public int layer_ind { get; set; }
    public bool bending_stiff { get; set; }

    // TODO: export local coordinate frame and import into conmech
  }

  public class ConmechFemMaterial
  {
    public ConmechFemMaterial(FemMaterial km) {
      // TODO: read unit from Karamba
      E_unit = "kN/m2";
      G12_unit = "kN/m2";
      fy_unit = "kN/m2";
      density_unit = "kN/m3";

      type_name = km.typeName();
      if (type_name != "ISO") {
        throw new ArgumentException("orthotropic material not implemented!!");
      }
      family = km.family;
      name = km.name;
      elem_tags = km.elemIds;
      E = km.E();
      G12 = km.G12();
      fy = km.fy();
      density = km.gamma();
    }

    public string family { get; set; }
    public string name { get; set; }
    public string type_name { get; set; }
    public string _source { get; set; }

    // list of element identifiers to which the cross section is to be attached.
    // applied to all elements if the list is empty
    public List<string> elem_tags { get; set; }

    public double E { get; set; }
    public string E_unit { get; set; }

    // in-plane shear modulus
    public double G12 { get; set; }
    public string G12_unit { get; set; }

    // transverse shear modulus
    //    public double G3 { get; set; }
    //    public string G3_unit { get; set; }

    // tensile yield stress
    public double fy { get; set; }
    public string fy_unit { get; set; }

    // gamma
    public double density { get; set; }
    public string density_unit { get; set; }
  }

  public class ConmechCrossSec {
    public ConmechCrossSec(CroSec_Beam kcs) {
      // TODO: read unit from Karamba
      A_unit = "m2";
      Iy_unit = "m4";
      Iz_unit = "m4";
      Jx_unit = "m4";

      family = kcs.family;
      name = kcs.name;
      elem_tags = kcs.elemIds;
      A = kcs.A;
      Jx = kcs.Ipp;
      Iy = kcs.Iyy;
      Iz = kcs.Izz;
    }

    public string family { get; set; }
    public string name { get; set; }
    public string _source { get; set; }

    // list of element identifiers to which the cross section is to be attached.
    // applied to all elements if the list is empty
    public List<string> elem_tags { get; set; }

    public double A { get; set; }
    public string A_unit { get; set; }
    public string _A_note { get; set; }

    // around local axis
    public double Jx { get; set; }
    public string Jx_unit { get; set; }
    public string _Jx_note { get; set; }

    public double Iy { get; set; }
    public string Iy_unit { get; set; }
    public string _Iy_note { get; set; }

    public double Iz { get; set; }
    public string Iz_unit { get; set; }
    public string _Iz_note { get; set; }
  }

  public class ConmechJoint
  {
    public ConmechJoint(Joint kj){
      c_conditions = new List<List<Nullable<double>>>();
      c_conditions.Add(kj.c_condition(0));
      c_conditions.Add(kj.c_condition(1));
      elem_tags = kj.elemIds;
    }
    public List<List<Nullable<double>>> c_conditions { get; set; }
    // element tags
    public List<string> elem_tags { get; set; }
  }

  public class ConmechSupport
  {
    public ConmechSupport(Support ks){
      condition = ks.Condition as List<bool>;
      node_ind = ks.node_ind;
    }
    public List<bool> condition { get; set; }
    public int node_ind { get; set; }
  }

  public class ConmechPointLoad
  {
    public ConmechPointLoad(PointLoad kf) {
      force = new List<double>(){kf.force.X, kf.force.Y, kf.force.Z};
      force_unit = "kN";
      moment = new List<double>(){kf.moment.X, kf.moment.Y, kf.moment.Z};
      moment_unit = "kNm";
      node_ind = kf.node_ind;
    }
    public List<double> force { get; set; }
    public string force_unit { get; set; }
    public List<double> moment { get; set; }
    public string moment_unit { get; set; }
    public int node_ind { get; set; }
  }

  public class ConmechUnifDistLoad
  {
    public ConmechUnifDistLoad(UniformlyDistLoad  kf) {
      Q = new List<double>(){kf.Q.X, kf.Q.Y, kf.Q.Z};
      Q_unit = "kN/m";
      Load = new List<double>(){kf.Load.X, kf.Load.Y, kf.Load.Z};
      // element tags
      elem_tags = kf.beamIds;
    }
    public List<double> Q { get; set; }
    public string Q_unit { get; set; }
    public List<double> Load { get; set; }
    public List<string> elem_tags { get; set; }
  }

  public class ConmechGravityLoad
  {
    public ConmechGravityLoad(GravityLoad kf) {
      force = new List<double>(){kf.force.X, kf.force.Y, kf.force.Z};
      force_unit = "kN";
    }
    public List<double> force { get; set; }
    public string force_unit { get; set; }
  }

  public class ConmechLoadCase
  {
    public List<ConmechPointLoad> ploads { get; set; }
    // TODO: only support uniformly dist element load for now
    public List<ConmechUnifDistLoad> eloads { get; set; }
    public ConmechGravityLoad gravity { get; set; }
  }

  public class ConmechModel
  {
    public string model_name { get; set; }
    public string unit { get; set; }
    public string generate_time { get; set; }

    public int node_num { get; set; }
    public int element_num { get; set; }

    public List<ConmechFrameNode> nodes { get; set; }
    public List<ConmechFrameElement> elements { get; set; }

    public List<ConmechSupport> supports { get; set; }
    public List<ConmechJoint> joints { get; set; }

    public List<ConmechCrossSec> cross_secs { get; set; }
    public List<ConmechFemMaterial> materials { get; set; }
  }
# ---------- end c_script_3 ----------

# ----
panel_9 = Panel(model_karamba3d)
panel_10 = Panel(c_script_3.out)

# ---- group: Analyze Model
analyze_karamba3d = AnalyzeKaramba3D(Model=assemble_model_karamba3d.Model)  # -> CalculatedModel, MaximumDisplacement_cm, ResultingForceOfGravity_kN, ElasticEnergy_kNm
displacement = Panel(analyze_karamba3d.MaximumDisplacement_cm)

# ----
disassemble_model_karamba3d = DisassembleModelKaramba3D(Model=analyze_karamba3d.CalculatedModel)  # -> Model, Point, Beam, Shell, Support, Load, Line, Mesh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
panel_11 = Panel(disassemble_model_karamba3d.Beam)
disassemble_cross_section_karamba3d = DisassembleCrossSectionKaramba3D(CroSec=cross_section_karamba3d)  # -> CrossSection, FamilyNameOfCrossSection, TypeNameOfCrossSection, ElemIdentifiers, Color, Material, LocalEccentricity_cm, Heights_cm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
panel_12 = Panel(disassemble_cross_section_karamba3d.Area_cm2)
panel_13 = Panel(disassemble_cross_section_karamba3d.Iyy_cm4)
panel_14 = Panel(disassemble_cross_section_karamba3d.Izz_cm4)
panel_15 = Panel(disassemble_cross_section_karamba3d.Ipp_cm4)
model_karamba3d_2 = ModelKaramba3D(analyze_karamba3d.CalculatedModel)
panel_16 = Panel(disassemble_cross_section_karamba3d.Material)
disassemble_material_karamba3d = DisassembleMaterialKaramba3D(Material=disassemble_cross_section_karamba3d.Material)  # -> Material, TypeOfMaterial, FamilyNameOfMaterial, NameOfMaterial, ElemIdentifiers, Color, YoungsModulusKNCm2Dir12, InPlaneShearModulus_kN_cm2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

# ---- group: Check Beam Internal Forces
# In local axis!
# -You can call a specific group of beams using
# the 'BeamIds' input.
# -Adding '3' to the resolution input provides values
# at the middle of each beam in addition to the
# two ends (default).
beam_forces_karamba3d = BeamForcesKaramba(AnalyzedModel=model_karamba3d_2, LCase=-1, MaximumDistanceBetweenResults_m=-1, NumberOfResultsPerBeamElement=2)  # -> AnalyzedModel, simplify(graft(NormalForce_kN)), simplify(graft(ShearForceVz_kN)), simplify(graft(ShearForceVy_kN)), simplify(graft(BendingMomentMt_kNm)), simplify(graft(BendingMomentMy_kNm)), simplify(graft(BendingMomentMz_kNm))

# ---- group: Check Beam Displacements
# In global axis!
# -You can call a specific group of beams using
# the 'BeamIds' input.
# -Adding '3' to the resolution input provides values
# at the middle of each beam in addition to the
# two ends (default).
beam_displacements_karamba3d = BeamDisplacementsKaramba(AnalyzedModel=model_karamba3d_2, LoadCase=-1, MaximumDistanceBetweenResults_ft=-1, NumberOfResultsPerElement=2)  # -> AnalyzedModel, simplify(graft(Translations_ft)), simplify(graft(Rotations_rad))
concatenate = Concatenate(FragmentA=beam_displacements_karamba3d.Translations_ft, FragmentB=beam_displacements_karamba3d.Rotations_rad)
panel_17 = Panel(concatenate)

# ----
reaction_forces_karamba3d = ReactionForcesKaramba3D(AnalyzedModel=model_karamba3d_2, ResultCase=0)  # -> AnalyzedModel, simplify(graft(ReactionForces_kN)), simplify(graft(ReactionMoments_kNm)), SupportPosition, SumOfReactionForces_kN, SumOfReactionMoments_kNm
panel_18 = Panel(reaction_forces_karamba3d.SumOfReactionForces_kN)
panel_19 = Panel(reaction_forces_karamba3d.SumOfReactionMoments_kNm)
panel_20 = Panel(reaction_forces_karamba3d.ReactionForces_kN)
panel_21 = Panel(reaction_forces_karamba3d.ReactionMoments_kNm)

# ---- group: View Results
model_view_karamba3d = ModelViewKaramba3D(Model=analyze_karamba3d.CalculatedModel, LoadCaseFactorsForLinearSuperposition=1, IndexOfVisibleLoadcase=-1)  # -> Model, DeformedMesh, DeformedAxes, DeformedModel
beam_view_karamba3d = BeamViewKaramba3D(Model=model_view_karamba3d.Model)  # -> Model, MeshesOfRenderedBeams, DeformedBeamAxes, LegendColors, LegendTags
legend = Legend(Colour=beam_view_karamba3d.LegendColors, Tags=beam_view_karamba3d.LegendTags, LegendType=1)

# ----
concatenate_2 = Concatenate(
    Fragment_A=beam_forces_karamba3d.NormalForce_kN,
    C=" | ",
    Fragment_B=beam_forces_karamba3d.ShearForceVy_kN,
    A=" | ",
    B=beam_forces_karamba3d.ShearForceVz_kN,
    E=" | ",
    D=beam_forces_karamba3d.BendingMomentMt_kNm,
    F=" | ",
    G=beam_forces_karamba3d.BendingMomentMy_kNm,
    H=" | ",
    I=beam_forces_karamba3d.BendingMomentMz_kNm)
panel_22 = Panel(concatenate_2)
concatenate_3 = Concatenate(FragmentA=reaction_forces_karamba3d.ReactionForces_kN, FragmentB=panel_21)
panel_23 = Panel(concatenate_3)
expression = Expression(E="2e4", mu="0.3", Expression="E/(2*(1+mu))")

# ----
# 0.1 kN/cm2 = 1 MPa
material_properties_karamba3d = MaterialPropertiesKaramba3D(
    FamilyOfMaterial="Steel",
    Name="S235",
    YoungsModulus_kN_cm2="2e4",
    InPlaneShearModulus_kN_cm2=expression,
    TransverseShearModulus_kN_cm2=expression,
    SpecificWeight_kN_m3=78.5,
    CoefficientOfThermalExpansion_1_C=1e-05,
    YieldStrength_kN_cm2=23.5,
    mode="Isotrop")

panel_24 = Panel("""-10,0,0
0,0,5""")
panel_25 = Panel("""0,0,0
8,0,0
13,0,0""")
point_7 = Point(panel_25)
cross_section_karamba3d_2 = CrossSectionKaramba3D(
    FamilyNameOfCrossSection="DefaultCroSec",
    Material=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,
    Diameter_cm=11.43,
    WallThickness_cm=0.4,
    mode="Circular Hollow")
square_root = SquareRoot(Value="2")
list_item_2 = ListItem(List=point_7, Index=0, Wrap=True)  # -> Item, Item1, Item2
division = Division(A=Slider(5, range=0..10), B=square_root)
negative = Negative(Value=division)
vector_xyz = VectorXYZ(XComponent="0", YComponent="0", ZComponent="50")  # -> Vector, Length
vector_xyz_2 = VectorXYZ(XComponent=division, YComponent=negative, ZComponent=0)  # -> Vector, Length
line = Line(StartPoint=list_item_2.Item1, EndPoint=list_item_2.Item2)
line_2 = Line(StartPoint=list_item_2.Item, EndPoint=list_item_2.Item1)
modify_cross_section_karamba3d = ModifyCrossSectionKaramba3D(
    CroSec=cross_section_karamba3d_2,
    ElementIdentifiers="ab",
    Material=material_properties_karamba3d,
    Area_cm2="60",
    Iyy_cm4="0",
    Izz_cm4="20000",
    Ipp_cm4="30",
    mode="Beam")
point_8 = Point(list_item_2.Item2)
modify_cross_section_karamba3d_2 = ModifyCrossSectionKaramba3D(
    CroSec=cross_section_karamba3d_2,
    ElementIdentifiers="bc",
    Material=material_properties_karamba3d,
    Area_cm2="40",
    Iyy_cm4="0",
    Izz_cm4="5000",
    Ipp_cm4="10",
    mode="Beam")
point_9 = Point(list_item_2.Item1)
point_10 = Point(list_item_2.Item)
line_to_beam_karamba3d_4 = LineToBeamKaramba3D(Line=line_2, Identifier="ab", New=True, Remove=True, LimitDistance_m=0.005)  # -> Element, Points, Info
line_to_beam_karamba3d_5 = LineToBeamKaramba3D(Line=line, Identifier="bc", New=True, Remove=True, LimitDistance_m=0.005)  # -> Element, Points, Info
loads_karamba3d_5 = LoadsKaramba3D(MomentVector=vector_xyz.Vector, Local=False, PosInd=point_9, LCase=0, mode="Point")
loads_karamba3d_6 = LoadsKaramba3D(ForceVector=vector_xyz_2.Vector, Local=False, PosInd=point_8, LCase=0, mode="Point")
support_karamba3d_7 = SupportKaramba(PosInd=point_9, menu=[buttons(off, on, on, on, on, off)])
support_karamba3d_8 = SupportKaramba(PosInd=point_8, menu=[buttons(on, on, on, on, on, on)])
support_karamba3d_9 = SupportKaramba(PosInd=point_8, menu=[buttons(off, off, on, on, on, off)])
support_karamba3d_10 = SupportKaramba(PosInd=point_10, menu=[buttons(on, on, on, on, on, on)])
cross_section_karamba3d_3 = CrossSectionKaramba3D([modify_cross_section_karamba3d, modify_cross_section_karamba3d_2])
support_karamba3d_11 = SupportKaramba3D([support_karamba3d_10, support_karamba3d_7, support_karamba3d_9])
disassemble_cross_section_karamba3d_2 = DisassembleCrossSectionKaramba3D(CroSec=cross_section_karamba3d_3)  # -> CrossSection, FamilyNameOfCrossSection, TypeNameOfCrossSection, ElemIdentifiers, Color, Material, LocalEccentricity_cm, Heights_cm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
assemble_model_karamba3d_2 = AssembleModelKaramba(
    Elem=[line_to_beam_karamba3d_4.Element, line_to_beam_karamba3d_5.Element],
    Support=support_karamba3d_11,
    Load=loads_karamba3d_6,
    CrossSection=cross_section_karamba3d_3,
    LimitDistance_m=0.005)  # -> Model, Info, Mass_kg, CenterOfGravity
panel_26 = Panel(disassemble_cross_section_karamba3d_2.Area_cm2)
panel_27 = Panel(disassemble_cross_section_karamba3d_2.Iyy_cm4)
panel_28 = Panel(disassemble_cross_section_karamba3d_2.Izz_cm4)
panel_29 = Panel(disassemble_cross_section_karamba3d_2.Ipp_cm4)
analyze_karamba3d_2 = AnalyzeKaramba3D(Model=assemble_model_karamba3d_2.Model)  # -> CalculatedModel, MaximumDisplacement_cm, ResultingForceOfGravity_kN, ElasticEnergy_kNm
panel_30 = Panel(disassemble_cross_section_karamba3d_2.Material)
disassemble_material_karamba3d_2 = DisassembleMaterialKaramba3D(Material=disassemble_cross_section_karamba3d_2.Material)  # -> Material, TypeOfMaterial, FamilyNameOfMaterial, NameOfMaterial, ElemIdentifiers, Color, YoungsModulusKNCm2Dir12, InPlaneShearModulus_kN_cm2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
model_karamba3d_3 = ModelKaramba3D(analyze_karamba3d_2.CalculatedModel)

# ---- group: View Results
model_view_karamba3d_2 = ModelViewKaramba3D(Model=analyze_karamba3d_2.CalculatedModel, LoadCaseFactorsForLinearSuperposition=1, IndexOfVisibleLoadcase=-1)  # -> Model, DeformedMesh, DeformedAxes, DeformedModel
beam_view_karamba3d_2 = BeamViewKaramba3D(Model=model_view_karamba3d_2.Model)  # -> Model, MeshesOfRenderedBeams, DeformedBeamAxes, LegendColors, LegendTags
legend_2 = Legend(Colour=beam_view_karamba3d_2.LegendColors, Tags=beam_view_karamba3d_2.LegendTags, LegendType=1)

# ---- group: Check Beam Internal Forces
# In local axis!
# -You can call a specific group of beams using
# the 'BeamIds' input.
# -Adding '3' to the resolution input provides values
# at the middle of each beam in addition to the
# two ends (default).
beam_forces_karamba3d_2 = BeamForcesKaramba(AnalyzedModel=model_karamba3d_3, LCase=-1, MaximumDistanceBetweenResults_m=-1, NumberOfResultsPerBeamElement=2)  # -> AnalyzedModel, simplify(graft(NormalForce_kN)), simplify(graft(ShearForceVz_kN)), simplify(graft(ShearForceVy_kN)), simplify(graft(BendingMomentMt_kNm)), simplify(graft(BendingMomentMy_kNm)), simplify(graft(BendingMomentMz_kNm))

# ---- group: Check Beam Displacements
# In global axis!
# -You can call a specific group of beams using
# the 'BeamIds' input.
# -Adding '3' to the resolution input provides values
# at the middle of each beam in addition to the
# two ends (default).
beam_displacements_karamba3d_2 = BeamDisplacementsKaramba(AnalyzedModel=model_karamba3d_3, LoadCase=-1, MaximumDistanceBetweenResults_ft=-1, NumberOfResultsPerElement=2)  # -> AnalyzedModel, simplify(graft(Translations_ft)), simplify(graft(Rotations_rad))
concatenate_4 = Concatenate(FragmentA=beam_displacements_karamba3d_2.Translations_ft, FragmentB=beam_displacements_karamba3d_2.Rotations_rad)
panel_31 = Panel(concatenate_4)

# ----
nodal_displacements_karamba3d = NodalDisplacementsKaramba3D(AnalyzedModel=model_karamba3d_2, ResultCase=0)  # -> AnalyzedModel, simplify(graft(NodalTranslations_m)), simplify(graft(NodalRotations_rad))
number_slider_2 = Slider(1, range=1..5)
multiplication = Multiplication(A=nodal_displacements_karamba3d.NodalTranslations_m, B=number_slider_2)
multiplication_2 = Multiplication(A=nodal_displacements_karamba3d.NodalRotations_rad, B=number_slider_2)
concatenate_5 = Concatenate(FragmentA=multiplication, FragmentB=multiplication_2)

panel_32 = Panel(concatenate_5)

reaction_forces_karamba3d_2 = ReactionForcesKaramba3D(AnalyzedModel=model_karamba3d_3, ResultCase=0)  # -> AnalyzedModel, simplify(graft(ReactionForces_kN)), simplify(graft(ReactionMoments_kNm)), SupportPosition, SumOfReactionForces_kN, SumOfReactionMoments_kNm
panel_33 = Panel(reaction_forces_karamba3d_2.SumOfReactionForces_kN)
panel_34 = Panel(reaction_forces_karamba3d_2.SumOfReactionMoments_kNm)
panel_35 = Panel(reaction_forces_karamba3d_2.ReactionForces_kN)
panel_36 = Panel(reaction_forces_karamba3d_2.ReactionMoments_kNm)

nodal_displacements_karamba3d_2 = NodalDisplacementsKaramba3D(AnalyzedModel=model_karamba3d_3, ResultCase=0)  # -> AnalyzedModel, simplify(graft(NodalTranslations_m)), simplify(graft(NodalRotations_rad))
number_slider_3 = Slider(1, range=1..5)
multiplication_3 = Multiplication(A=nodal_displacements_karamba3d_2.NodalTranslations_m, B=number_slider_3)
multiplication_4 = Multiplication(A=nodal_displacements_karamba3d_2.NodalRotations_rad, B=number_slider_3)
concatenate_6 = Concatenate(FragmentA=multiplication_3, FragmentB=multiplication_4)
panel_37 = Panel(concatenate_6)

concatenate_7 = Concatenate(
    Fragment_A=beam_forces_karamba3d_2.NormalForce_kN,
    C=" | ",
    Fragment_B=beam_forces_karamba3d_2.ShearForceVy_kN,
    A=" | ",
    B=beam_forces_karamba3d_2.ShearForceVz_kN,
    E=" | ",
    D=beam_forces_karamba3d_2.BendingMomentMt_kNm,
    F=" | ",
    G=beam_forces_karamba3d_2.BendingMomentMy_kNm,
    H=" | ",
    I=beam_forces_karamba3d_2.BendingMomentMz_kNm)
panel_38 = Panel(concatenate_7)
concatenate_8 = Concatenate(FragmentA=reaction_forces_karamba3d_2.ReactionForces_kN, FragmentB=panel_36)
panel_39 = Panel(concatenate_8)
