# Grasshopper definition sf-3_frame.gh (Grasshopper 1.0.7)
# plug-ins: Karamba

number_slider = Slider(0.5, range=0..1)
# manual layer selection
# DON'T FORGET TO INTERNALIZE
# DATA WHEN FINISHED!
# layer viewer
number_slider_2 = Slider(0.7, range=0..1)
negative = Negative(Value=number_slider)
xy_plane = XYPlane(Origin=Point(0, 0, 0))
circle = Circle(Plane=xy_plane, Radius=number_slider_2)
construct_domain = ConstructDomain(DomainStart=negative, DomainEnd=number_slider)
divide_curve = DivideCurve(Curve=circle, Count="3", Kinks=False, UseTasks=True)  # -> Points, Tangents, Parameters
rectangle = Rectangle(Plane=xy_plane, XSize=construct_domain, YSize=construct_domain, Radius=0)  # -> Rectangle, Length
unit_z = UnitZ(Factor=Slider(1, range=0..1))
brep = Brep(rectangle.Rectangle)
list_item = ListItem(List=divide_curve.Points, Index=0, Wrap=True)  # -> Item, Item1
deconstruct_brep = DeconstructBrep(Brep=brep)  # -> Faces, Edges, Vertices
point = Point(xy_plane)
# 1 pa = 1 N/m^2 = 1e-7 kN/cm^2 = 1e-9 kN/mm^2
material_properties_karamba3d = MaterialPropertiesKaramba3D(
    FamilyOfMaterial="Steel",
    Name="S235",
    YoungsModulus_kN_cm2=21000,
    InPlaneShearModulus_kN_cm2=8076,
    TransverseShearModulus_kN_cm2=8076,
    SpecificWeight_kN_m3=78.5,
    CoefficientOfThermalExpansion_1_C=1e-05,
    YieldStrength_kN_cm2=23.5,
    mode="Isotrop")
move = Move(Geometry=point, Motion=unit_z)  # -> Geometry, Transform
point_2 = Point(flatten(deconstruct_brep.Vertices))
point_3 = Point(flatten(divide_curve.Points))
number_slider_3 = Slider(500, range=0..1000)
number_slider_4 = Slider(0.1, range=0..0.1)

# ----
# grounded verts
point_4 = Point(point_3)

# ----
# loaded vert
point_5 = Point(move.Geometry)

panel = Panel(material_properties_karamba3d)
negative_2 = Negative(Value=number_slider_4)
unit_x = UnitX(Factor=number_slider_4)
disassemble_material_karamba3d = DisassembleMaterialKaramba3D(Material=material_properties_karamba3d)  # -> Material, TypeOfMaterial, FamilyNameOfMaterial, NameOfMaterial, ElemIdentifiers, Color, YoungsModulusKNCm2Dir12, InPlaneShearModulus_kN_cm2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
cm = Panel("5")
unit_z_2 = UnitZ(Factor=negative_2)
panel_2 = Panel(unit_z_2)
division = Division(A=cm, B="2")
multiplication = Multiplication(A=division, B="10")
cross_section_karamba3d = CrossSectionKaramba3D(
    FamilyNameOfCrossSection="DefaultCroSec",
    Material=material_properties_karamba3d,
    Diameter_cm=cm,
    WallThickness_cm=division,
    mode="Circular Hollow")
line = Line(StartPoint=point_3, EndPoint=move.Geometry)
radius_mm = Panel(multiplication)
concatenate = Concatenate(
    Fragment_A=disassemble_material_karamba3d.FamilyNameOfMaterial,
    A="-",
    Fragment_B=disassemble_material_karamba3d.NameOfMaterial)
length = Length(Curve=line)
panel_3 = Panel(concatenate)
# 1 kN/m^3 = 1000/9.8 kg/m^3
panel_4 = Panel(disassemble_material_karamba3d.SpecificWeight_kN_m3)
support_karamba3d = SupportKaramba3D(PosInd=point_4, menu=[buttons(on, on, on, off, off, off)])
# kN
loads_karamba3d = LoadsKaramba3D(ForceVector=unit_z_2, Local=False, PosInd=point_5, LCase="0", mode="Point")
loads_karamba3d_2 = LoadsKaramba3D(Vector=Vector(0, 0, -1), LCase="1", mode="Gravity")
multiplication_2 = Multiplication(A=disassemble_material_karamba3d.InPlaneShearModulus_kN_cm2, B="10")
multiplication_3 = Multiplication(A=disassemble_material_karamba3d.YoungsModulusKNCm2Dir12, B="10")
panel_5 = Panel(length)
panel_6 = Panel(cross_section_karamba3d)
multiplication_4 = Multiplication(A=panel_4, B="1000/9.8")
line_to_beam_karamba3d = LineToBeamKaramba3D(Line=line, CrossSection=cross_section_karamba3d, New=True, Remove=True, LimitDistance_m=0.005)  # -> Element, Points, Info
beam_joints_karamba3d = BeamJointsKaramba3D(
    CtKNMAtStartingNode=Vector(0, 0, 0),
    CrKNmRadAtStartingNode=Vector(0, 0, 0),
    CtKNMAtEndNode=Vector(0, 0, 0),
    CrKNmRadAtEndNode=Vector(0, 0, 0),
    menu=[buttons(off, off, off, on, on, on), buttons(off, off, off, on, on, on)])
evaluate = Evaluate(Expression="E/(2*G) - 1", E=multiplication_3, G=multiplication_2)
mpa = Panel(multiplication_3)
mpa_2 = Panel(multiplication_2)
density_kg_m_3 = Panel(multiplication_4)
panel_7 = Panel(evaluate)
assemble_model_karamba3d = AssembleModelKaramba3D(
    Elem=line_to_beam_karamba3d.Element,
    Support=support_karamba3d,
    Load=[loads_karamba3d, loads_karamba3d_2],
    Material=material_properties_karamba3d,
    Joint=beam_joints_karamba3d,
    LimitDistance_m=0.005)  # -> Model, Info, Mass_kg, CenterOfGravity
point_6 = Point(point_3)
curve = Curve(line)
number_slider_5 = Slider(0, range=0..1)
curve_2 = Curve(flatten(curve))
analyze_karamba3d = AnalyzeKaramba3D(Model=assemble_model_karamba3d.Model)  # -> CalculatedModel, MaximumDisplacement_cm, ResultingForceOfGravity_kN, ElasticEnergy_kNm
beam_forces_karamba3d = BeamForcesKaramba3D(
    AnalyzedModel=analyze_karamba3d.CalculatedModel,
    LCase=number_slider_5,
    MaximumDistanceBetweenResults_m=-1,
    NumberOfResultsPerBeamElement=2)  # -> AnalyzedModel, NormalForce_kN, ShearForceVz_kN, ShearForceVy_kN, BendingMomentMt_kNm, BendingMomentMy_kNm, BendingMomentMz_kNm
reaction_forces_karamba3d = ReactionForcesKaramba3D(AnalyzedModel=analyze_karamba3d.CalculatedModel, LoadCase=number_slider_5)  # -> AnalyzedModel, ReactionForces_kN, ReactionMoments_kNm, SupportPosition, SumOfReactionForces_kN, SumOfReactionMoments_kNm
nodal_displacements_karamba3d = NodalDisplacementsKaramba3D(AnalyzedModel=analyze_karamba3d.CalculatedModel, LoadCase=number_slider_5)  # -> AnalyzedModel, NodalTranslations_m, NodalRotations_rad
list_item_2 = ListItem(List=reaction_forces_karamba3d.SupportPosition, Index=Slider(0, range=0..2), Wrap=True)
multiplication_5 = Multiplication(A=beam_forces_karamba3d.NormalForce_kN, B="1")
axial_kn = Panel(multiplication_5)
multiplication_6 = Multiplication(A=beam_forces_karamba3d.ShearForceVz_kN, B="1")
multiplication_7 = Multiplication(A=beam_forces_karamba3d.ShearForceVy_kN, B="1")
vy_kn = Panel(multiplication_7)
multiplication_8 = Multiplication(A=beam_forces_karamba3d.BendingMomentMt_kNm, B="1e6")
multiplication_9 = Multiplication(A=beam_forces_karamba3d.BendingMomentMy_kNm, B="1e6")
point_7 = Point(list_item_2)
multiplication_10 = Multiplication(A=beam_forces_karamba3d.BendingMomentMz_kNm, B="1e6")
vz_kn = Panel(multiplication_6)
mt_n_mm = Panel(multiplication_8)
multiplication_11 = Multiplication(A=reaction_forces_karamba3d.ReactionForces_kN, B="1")
multiplication_12 = Multiplication(A=reaction_forces_karamba3d.ReactionMoments_kNm, B="1")
multiplication_13 = Multiplication(A=nodal_displacements_karamba3d.NodalTranslations_m, B="1")
my_n_mm = Panel(multiplication_9)
vb_script = VBScript()  # -> A
# ---------- vb_script: VB ----------
    Dim envString As String

    envString = Environ("USERPROFILE")
    A = envString
# ---------- end vb_script ----------
reaction_moment_kn_m = Panel(multiplication_12)
reaction_force_kn = Panel(multiplication_11)

tranlation_m = Panel(multiplication_13)
rotation_rad = Panel(nodal_displacements_karamba3d.NodalRotations_rad)

mz_n_mm = Panel(multiplication_10)
scale = Slider(1, range=0..1)
scale_2 = Scale(Geometry=curve_2, Center=Point(0, 0, 0), Factor=scale)  # -> Geometry, Transform
curve_3 = Curve(scale_2.Geometry)
cluster = Cluster(curve=curve_3)  # -> output_nodes, output_lines, nodes_data, lines_data, result
panel_8 = Panel("S")
concatenate_2 = Concatenate(Fragment_A=vb_script, Fragment_B="\Desktop\", A="framefab_mpp_test_models\")
model_view_karamba3d = ModelViewKaramba3D(Model=analyze_karamba3d.CalculatedModel, LoadCaseFactorsForLinearSuperposition=1, IndexOfVisibleLoadcase=number_slider_5)  # -> Model, DeformedMesh, DeformedAxes, DeformedModel
beam_view_karamba3d = BeamViewKaramba3D(Model=model_view_karamba3d.Model)  # -> Model, MeshesOfRenderedBeams, DeformedBeamAxes, LegendColors, LegendTags
panel_9 = Panel(cluster.result)

# ----
# file name
panel_10 = Panel("sf-test_3-frame")

point_8 = Point(cluster.output_nodes)
curve_4 = Curve(cluster.output_lines)

# ----
# date suffix
c_script = CSharpScript()  # -> out, A
# ---------- c_script: C# ----------
    //    A = string.Format("{0:HH:mm:ss tt}", DateTime.Now);
    DateTime dateTime = DateTime.UtcNow.Date;
    A = dateTime.ToString("_MM-dd-yyyy");
# ---------- end c_script ----------

text = Text(flatten(concatenate_2))

# ----
# save path
concatenate_3 = Concatenate(FragmentA=text, FragmentC="orginal_models\", FragmentB="sf-test_4-frame\")

# ----
# grounded nodes
point_9 = Point(point_6)

concatenate_4 = Concatenate(Fragment_A=panel_10, A=".json")
list_length = ListLength()  # disabled
point_10 = Point(point_8)
distance = Distance(PointA=graft(point_10), PointB=point_9)  # -> simplify(Distance)
integer = Integer(flatten(cluster.result))
series = Series(Start=0, Step=1, Count=list_length)  # disabled
concatenate_5 = Concatenate(FragmentA=concatenate_3, FragmentB=concatenate_4)
average = Average(Input=point_9)
mass_multiplication = MassMultiplication(Input=distance)  # -> Result, PartialResults
integer_2 = Integer(graft(series))  # disabled
integer_3 = Integer()  # disabled
panel_11 = Panel(concatenate_5)
match_tree = MatchTree(Tree=integer_2, Guide=integer_3)  # disabled
merge = Merge(Data1=integer_3, Data2=match_tree)  # -> simplify(flatten(Result)); disabled
boolean = Boolean(mass_multiplication.Result)
multiplication_14 = Multiplication(A="{600, 0, 23.5}", B=0.001)
integer_4 = Integer(flatten(boolean))
merge_2 = Merge(Data1=integer, Data2=merge)
subtraction = Subtraction(A=point_10, B=average)
subtraction_2 = Subtraction(A="1", B=integer_4)
xy_plane_2 = XYPlane(Origin=multiplication_14)  # disabled
partition_list = PartitionList(List=merge_2, Size=2)  # -> simplify(Chunks)
panel_12 = Panel(partition_list)
integer_5 = Integer(subtraction_2)
point_11 = Point(subtraction)
point_12 = Point(point_11)
list_item_3 = ListItem(List=point_12, Index=partition_list, Wrap=False)
dispatch = Dispatch(List=point_12, DispatchPattern=integer_5)  # -> ListA, ListB
list_item_4 = ListItem(List=list_item_3, Index=0, Wrap=True)  # -> Item, Item1
panel_13 = Panel(list_item_3)
number = Number(evaluate)
number_2 = Number(multiplication)
number_3 = Number(multiplication_4)
text_2 = Text(concatenate)
number_4 = Number(multiplication_3)
number_5 = Number(multiplication_2)
line_2 = Line(StartPoint=list_item_4.Item, EndPoint=list_item_4.Item1)
list_item_5 = ListItem(List=point_11, Index=Slider(4, range=0..4), Wrap=False)
point_13 = Point(dispatch.ListA)
panel_14 = Panel(number_3)
panel_15 = Panel(number)
panel_16 = Panel(number_2)
panel_17 = Panel(number_4)
panel_18 = Panel(number_5)
point_14 = Point(list_item_5)
c_script_2 = CSharpScript(
    file_path=concatenate_5,
    model_type="spatial_frame",
    assembly_type="extrusion",
    unit="meter",
    relative_pos_to_robot_base=xy_plane_2,
    node_pts=point_11,
    ground_nodes_identifier=integer_5,
    elements=partition_list,
    material_name=text_2,
    youngs_modulus=panel_17,
    youngs_modulus_unit="MPa",
    shear_modulus=panel_18,
    shear_modulus_unit="MPa",
    poisson_ratio=panel_15,
    radius=panel_16,
    radius_unit="millimeter",
    density=panel_14,
    density_unit="kg/m3",
    Reference="C:\USERS\YIJIANGH\DESKTOP\FrameFabGH\Newtonsoft.Json.dll")  # -> out, A; inputs file_path: String, model_type: String, assembly_type: String, unit: String, relative_pos_to_robot_base: Plane, node_pts: list of Point3d, ground_nodes_identifier: list of Int32, elements: tree of Int32, material_name: String, youngs_modulus: Double, youngs_modulus_unit: String, shear_modulus: Double, shear_modulus_unit: String, poisson_ratio: Double, radius: Double, radius_unit: String, density: Double, density_unit: String
# ---------- c_script_2: C# usings ----------
using System.IO;
using System.Linq;
using System.Data;
using System.Drawing;
using System.Reflection;
using System.Windows.Forms;
using System.Xml;
using System.Xml.Linq;
using System.Runtime.InteropServices;

using Rhino.DocObjects;
using Rhino.Collections;
using GH_IO;
using GH_IO.Serialization;
using Newtonsoft.Json;
using Newtonsoft.Json.Serialization;
using Newtonsoft.Json.Schema;
using Newtonsoft.Json.Linq;
using Newtonsoft.Json.Converters;
using Newtonsoft.Json.Bson;
# ---------- c_script_2: C# ----------
    JsonSerializer serializer = new JsonSerializer();
    serializer.NullValueHandling = NullValueHandling.Ignore;
    serializer.Formatting = Newtonsoft.Json.Formatting.Indented;

    // init assembly sequence obj, wire in global params
    ChoreoInputModel cas = new ChoreoInputModel();
    cas.assembly_type = assembly_type;
    cas.model_type = model_type;
    cas.unit = unit;

    cas.base_frame_in_rob_base = relative_pos_to_robot_base;

    cas.material_properties = new MaterialProperty();
    cas.material_properties.material_name = material_name;
    cas.material_properties.youngs_modulus = youngs_modulus;
    cas.material_properties.youngs_modulus_unit = youngs_modulus_unit;

    cas.material_properties.shear_modulus = shear_modulus;
    cas.material_properties.shear_modulus_unit = shear_modulus_unit;

    cas.material_properties.poisson_ratio = poisson_ratio;

    cas.material_properties.radius = radius;
    cas.material_properties.radius_unit = radius_unit;

    cas.material_properties.density = density;
    cas.material_properties.density_unit = density_unit;

    cas.node_list = new List<FrameNode>(node_pts.Count());
    cas.element_list = new List<FrameElement>(elements.BranchCount);

    // create nodes
    for(int i = 0; i < node_pts.Count(); i++)
    {
      FrameNode nd = new FrameNode();
      nd.point = node_pts[i];
      nd.is_grounded = ground_nodes_identifier[i];

      cas.node_list.Add(nd);
    }

    // create each sequenced element
    for(int i = 0; i < elements.BranchCount; i++)
    {
      FrameElement ne = new FrameElement();
      ne.end_node_ids = new List<int>();

      ne.end_node_ids = elements.Branch(i);

      cas.element_list.Add(ne);
    }

    // GH screen output
    //    string json = JsonConvert.SerializeObject(cas, Newtonsoft.Json.Formatting.Indented);
    //    Print(json);

    // serialize to json file
    using (StreamWriter sw = new StreamWriter(@file_path))
    using (JsonWriter writer = new JsonTextWriter(sw))
    {
      serializer.Serialize(writer, cas);
    }
# ---------- c_script_2: C# additional code ----------
  public class FrameNode
  {
    public Point3d point { get; set; }
    public int is_grounded { get; set; }
  }

  public class FrameElement
  {
    public List<int> end_node_ids { get; set; }
    public int layer_id { get; set; }
  }

  public class MaterialProperty
  {
    public string material_name { get; set; }
    public double youngs_modulus { get; set; }
    public string youngs_modulus_unit { get; set; }

    public double shear_modulus { get; set; }
    public string shear_modulus_unit { get; set; }

    public double density { get; set; }
    public string density_unit { get; set; }

    public double poisson_ratio { get; set; }

    public double radius { get; set; }
    public string radius_unit { get; set; }
  }

  public class ChoreoInputModel
  {
    public string assembly_type { get; set; }
    public string model_type { get; set; }
    public string unit { get; set; }

    public Plane base_frame_in_rob_base { get; set; }

    public MaterialProperty material_properties { get; set; }

    public List<FrameNode> node_list { get; set; }
    public List<FrameElement> element_list { get; set; }
  }
# ---------- end c_script_2 ----------

# ==== cluster Cluster
curve = ClusterInput()
end_points = EndPoints(Curve=curve)  # -> Start, End
merge = Merge(Data1=end_points.Start, Data2=end_points.End)
create_set = CreateSet(List=merge)  # -> Set, Map
number_slider = Slider(1, range=0..1)
member_index = MemberIndex(Set=create_set.Set, Member=end_points.End)  # -> Index, Count
member_index_2 = MemberIndex(Set=create_set.Set, Member=end_points.Start)  # -> Index, Count
deconstruct = Deconstruct(Point=create_set.Set)  # -> XComponent, YComponent, ZComponent
addition = Addition(A=member_index_2.Index, B=number_slider)
addition_2 = Addition(A=member_index.Index, B=number_slider)
integer = Integer(addition)
integer_2 = Integer(addition_2)
merge_2 = Merge(Data1=member_index_2.Index, Data2=member_index.Index)  # -> simplify(Result)
concatenate = Concatenate(
    Fragment_A="v",
    G=" ",
    Fragment_B=deconstruct.XComponent,
    A=" ",
    B=deconstruct.YComponent,
    C=" ",
    D=deconstruct.ZComponent)  # -> flatten(Result)
concatenate_2 = Concatenate(Fragment_A="l", Fragment_B=" ", A=integer, B=" ", C=integer_2)  # -> flatten(Result)
panel = Panel(merge_2)
result = ClusterOutput(merge_2)

# ----
# output_lines
curve_2 = Curve(curve)

# ----
# output_nodes
point = Point(create_set.Set)

# ----
# nodes_data
text = Text(concatenate)

# ----
# lines_data
text_2 = Text(concatenate_2)

output_nodes = ClusterOutput(point)  # output_nodes
output_lines = ClusterOutput(curve_2)
nodes_data = ClusterOutput(text)
lines_data = ClusterOutput(text_2)
