# Grasshopper definition stiffness_checker_compare_karamba.ghx (Grasshopper 1.0.7)
# plug-ins: Karamba

panel = Panel("C:\Users\harry\Documents\pb-construction\conmech\tests\gh_scripts")
concatenate = Concatenate(Fragment_A=panel, A="\", Fragment_B="voronoi_analysis_res.json")
concatenate_2 = Concatenate(Fragment_A=panel, A="\", Fragment_B="voronoi_solution.json")
panel_2 = Panel("tower_3D.json")
panel_3 = Panel("C:\Users\harry\Documents\pb-construction\conmech\tests\test_data")

# ----
# file name
panel_4 = Panel("topopt-100.json")

python = PythonScript()  # -> rhino_doc_dir
# ---------- python: Python ----------
import scriptcontext as sc
from os import path

rhino_doc_dir = path.abspath(path.dirname(sc.doc.Path))
# ---------- end python ----------
ghpython_script = GhPythonScript(seq_result_file_path=concatenate_2)  # -> out, seq_e_ids
# ---------- ghpython_script: Python ----------
__author__ = "harry"
__version__ = "2019.08.22"

import rhinoscriptsyntax as rs
import json

with open(seq_result_file_path, 'r') as f:
    json_data = json.loads(f.read())

seq_e_ids = json_data['plan']
del json_data['plan']
print(json_data)
# ---------- end ghpython_script ----------
add = Button()
panel_5 = Panel("C:\Users\harry\Documents\pb-construction\conmech\tests\assembly_instances\extrusion")
subs = Button()
data_recorder = DataRecorder(add, DataLimit=-10, RecordData=True)
data_recorder_2 = DataRecorder(subs, DataLimit=-10, RecordData=True)
list = ValueList({"CRITICAL", "ERROR", "WARNING", "INFO", "DEBUG", "NOTSET"}, selected="DEBUG")

# ---- group: Import remote python modules
panel_6 = Panel(python)
# Turn me on!   -->
panel_7 = Panel("""numpy
numpy.linalg
pyconmech.frame_analysis""")
ghpythonremote = GHPythonRemote(location="conda://py2", run=Toggle(True), modules=panel_7, log_level=list, working_dir=panel_6)  # -> out, linked_modules, rpy; inputs run: Boolean, modules: list
# ---------- ghpythonremote: Python ----------
import sys
import scriptcontext
import logging
import inspect
import ghpythonremote
from ghpythonremote.connectors import GrasshopperToPythonRemote
from os import path
from time import sleep

local_log_level = getattr(logging, log_level, logging.WARNING)
logger = logging.getLogger('ghpythonremote')
logger.setLevel(local_log_level)
ch = logging.StreamHandler()
ch.setLevel(local_log_level)
formatter = logging.Formatter('%(levelname)s: %(name)s:\n%(message)s')
ch.setFormatter(formatter)
logger.handlers = []
logger.addHandler(ch)
logger = logging.getLogger('ghpythonremote.GH_to_python_sticky')

ROOT = path.abspath(path.dirname(inspect.getfile(ghpythonremote)))
rpyc_server_py = path.join(ROOT, 'pythonservice.py')

# Set connection to CLOSED if this is the first run
# and initialize set of linked modules
try:
    remote_python_status
except NameError:
    remote_python_status = 'CLOSED'
    lkd_modules = set()

# Wait for connection to connect or terminate
timer = 0
while remote_python_status == 'CONNECTING' or remote_python_status == 'CLOSING':
    sleep(1)
    timer += 1
    if timer == 10:
        try:
            gh2py_manager.__exit__(*sys.exc_info())
        except Exception:
            pass
        remote_python_status = 'CLOSED'
        lkd_modules = set()
        raise RuntimeError("Connection left in an inconsistent state and not returning. Reset everything.")

if run:
    if not remote_python_status == 'OPEN':
        remote_python_status = 'CONNECTING'
        gh2py_manager = GrasshopperToPythonRemote(rpyc_server_py, location=location, timeout=10,
                                                  port=None, log_level=log_level, working_dir=working_dir)
        gh2py = gh2py_manager.__enter__()
        remote_python_status = 'OPEN'

    # Stuff that we can reach
    rpymod = gh2py.py_remote_modules  # A getter function for a named python module
    rpy = gh2py.connection  # Represents the remote instance root object
    scriptcontext.sticky['rpy'] = rpy
    # Add modules
    for mod in modules:
        try:
            scriptcontext.sticky[mod] = rpymod(mod)
            lkd_modules.add(mod)
        except ImportError:
            gh2py_manager.__exit__(*sys.exc_info())
            raise

elif not remote_python_status == 'CLOSED':
    remote_python_status = 'CLOSING'
    # Remove linked modules
    for mod in lkd_modules:
        del scriptcontext.sticky[mod]
    del scriptcontext.sticky['rpy']
    gh2py_manager.__exit__(*sys.exc_info())
    lkd_modules = set()
    remote_python_status = 'CLOSED'

# Change variable name because ghpython resets outputs to None before each run
linked_modules = lkd_modules

logger.info('GH to python connection is {}'.format(remote_python_status))
# ---------- end ghpythonremote ----------
panel_8 = Panel(ghpythonremote.out)

# ----
python_2 = PythonScript(module_names=ghpythonremote.linked_modules)  # -> import_statements; inputs module_names: list
# ---------- python_2: Python ----------
import_statements = ["import scriptcontext as sc"]
for module_name in module_names:
    import_statements.append("{0} = sc.sticky['{0}']".format(module_name))

if len(module_names) == 0:
    import_statements = []
# ---------- end python_2 ----------
integer = Integer(ghpython_script.seq_e_ids)
mass_addition = MassAddition(Input=data_recorder_2)  # -> Result, PartialResults
mass_addition_2 = MassAddition(Input=data_recorder)  # -> Result, PartialResults
concatenate_3 = Concatenate(Fragment_A=panel_5, A="\", Fragment_B="voronoi_S1_03-14-2019_w_layer.json")
panel_9 = Panel(python_2)
subtraction = Subtraction(A=mass_addition_2.Result, B=mass_addition.Result)
split_list = SplitList(List=integer, Index=subtraction)  # -> flatten(ListA), ListB
panel_10 = Panel(subtraction)
integer_2 = Integer(split_list.ListA)
ghpython_script_2 = GhPythonScript(frame_json_file_path=concatenate_3, scale=Slider(1, range=0..1000), use_existing_ids=Toggle(False))  # -> out, simplify(all_element_ids), all_nodes, all_elements, existing_elements, existing_nodes, fix_node_ids, material_name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; inputs existing_ids: list of Int32, use_existing_ids: Boolean
# ---------- ghpython_script_2: Python ----------
import rhinoscriptsyntax as rs
import Rhino.Geometry as rg
from Grasshopper import DataTree as datatree
from Grasshopper.Kernel.Data import GH_Path as ghpath
import System
import math

from ghpythonlib.treehelpers import list_to_tree, tree_to_list
#from compas.rpc import Proxy
#cm = Proxy('pyconmech.frame_analysis.stiffness_solve_fn')

import scriptcontext as sc
cm = sc.sticky['pyconmech.frame_analysis']
numpy = sc.sticky['numpy']
numpy.linalg = sc.sticky['numpy.linalg']

def rvector2list(rv):
    return [rv.X, rv.Y, rv.Z]


frame_info = cm.read_frame_json(frame_json_file_path)

node_points, element_vids, _fix_node_ids, fix_specs, model_type, material_dicts, model_name = frame_info

all_nodes = [rs.CreatePoint(scale*pt[0], scale*pt[1], scale*pt[2]) for pt in node_points]
all_elements = [rg.Line(all_nodes[n1], all_nodes[n2]) for n1, n2 in element_vids]

if not use_existing_ids:
    existing_ids = list(range(len(element_vids)))

existing_elements = datatree[System.Object]()

for e_id in existing_ids:
    existing_elements.Add(rg.Line(all_nodes[element_vids[e_id][0]], all_nodes[element_vids[e_id][1]]), ghpath(e_id))

existing_node_ids = set()
for e_id, e_tuple in enumerate(element_vids):
    if e_id in existing_ids:
        existing_node_ids.update(e_tuple)

existing_nodes = datatree[System.Object]()
for n_id in existing_node_ids:
    existing_nodes.Add(all_nodes[n_id], ghpath(n_id))

fix_node_ids = [int(v) for v in _fix_node_ids if v in existing_node_ids]

material_name = material_dicts[0]['material_name']
E = material_dicts[0]['youngs_modulus']
E_unit = material_dicts[0]['youngs_modulus_unit']

G = material_dicts[0]['shear_modulus']
G_unit = material_dicts[0]['shear_modulus_unit']

if 'tensile_yeild_stress' in material_dicts[0]:
    sigma = material_dicts[0]['tensile_yeild_stress']
    sigma_unit = material_dicts[0]['tensile_yeild_stress_unit']

rho = material_dicts[0]['density']
rho_unit = material_dicts[0]['density_unit']

r = math.sqrt(material_dicts[0]['cross_sec_area'] / math.pi)
r_unit = 'centimeter'
# ---------- end ghpython_script_2 ----------
series = Series(Start=0, Step=1, Count=Slider(10, range=0..24))  # -> flatten(Series)
ghpython_script_3 = GhPythonScript(frame_json_file_path=concatenate_3, result_file_path=concatenate, existing_ids=split_list.ListA, include_sw=Toggle(True))  # -> out, solve_success, element_reaction, node_displacement, fixities_reaction, local_coordinate_frames; inputs existing_ids: list of Int32, include_sw: Boolean; disabled
# ---------- ghpython_script_3: Python ----------
import rhinoscriptsyntax as rs
import Rhino.Geometry as rg
from Grasshopper import DataTree as datatree
from Grasshopper.Kernel.Data import GH_Path as ghpath
import System
import os
import json

from ghpythonlib.treehelpers import list_to_tree
#from compas.rpc import Proxy
#cm = Proxy('pyconmech.frame_analysis.stiffness_solve_fn')

import scriptcontext as sc
cm = sc.sticky['pyconmech.frame_analysis']
#numpy = sc.sticky['numpy']
#numpy.linalg = sc.sticky['numpy.linalg']

cm.stiffness_checker_parse_file_and_save_result(frame_json_file_path, result_file_path, existing_ids=existing_ids, include_sw=include_sw)

assert os.path.exists(result_file_path) and "json file path does not exist!"
with open(result_file_path, 'r') as f:
    json_data = json.loads(f.read())


solve_success = json_data['solve_success']

print('trans tol : {}, rot_tol : {}'.format(json_data['trans_tol'], json_data['rot_tol']))

er_tree = datatree[System.Double]()
nd_tree = datatree[System.Double]()
fr_tree = datatree[System.Double]()
local_planes = datatree[System.Double]()

for nd_data in json_data['node_displacement']:
    n_id = nd_data['node_id']
    for val in nd_data['displacement']:
        nd_tree.Add(val, ghpath(n_id))

for fr_data in json_data['fixity_reaction']:
    n_id = fr_data['node_id']
    for val in fr_data['reaction']:
        fr_tree.Add(val, ghpath(n_id))

for er_data in json_data['element_reaction']:
    e_id = er_data['element_id']
    for val in er_data['reaction']['0']:
        er_tree.Add(val, ghpath(e_id, 0))
    for val in er_data['reaction']['1']:
        er_tree.Add(val, ghpath(e_id, 1))
    e_LG = er_data['local_to_global_transformation']
    for i in range(3):
        for j in range(3):
            num = e_LG[j][i]
            local_planes.Add(num, ghpath(e_id, j))

element_reaction = er_tree
node_displacement = nd_tree
fixities_reaction = fr_tree
local_coordinate_frames = local_planes
# ---------- end ghpython_script_3 ----------
panel_11 = Panel(ghpython_script_3.out)
point = Point(ghpython_script_2.all_nodes)
curve = Curve(ghpython_script_2.all_elements)
number = Number(ghpython_script_3.local_coordinate_frames)
list_item = ListItem(List=curve, Index=integer_2, Wrap=True)
data = Data(ghpython_script_2.G_unit)
data_2 = Data(ghpython_script_2.material_name)
data_3 = Data(ghpython_script_2.E)
data_4 = Data(ghpython_script_2.G)
data_5 = Data(ghpython_script_2.E_unit)
data_6 = Data(ghpython_script_2.r)
data_7 = Data(ghpython_script_2.sigma)
data_8 = Data(ghpython_script_2.rho)
data_9 = Data(ghpython_script_2.sigma_unit)
data_10 = Data(ghpython_script_2.rho_unit)
data_11 = Data(ghpython_script_2.r_unit)
panel_12 = Panel(data_3)
panel_13 = Panel(data_4)
panel_14 = Panel(data_5)
panel_15 = Panel(data_10)
panel_16 = Panel(data_11)
panel_17 = Panel(data_2)
panel_18 = Panel(data)
panel_19 = Panel(data_7)
panel_20 = Panel(data_9)
panel_21 = Panel(data_8)
panel_22 = Panel(data_6)
curve_2 = Curve(list_item)
curve_3 = Curve(reparameterize(simplify(curve_2)))
tree_statistics = TreeStatistics(Tree=curve_3)  # -> Paths, Length, Count
cluster = Cluster_4(branch=tree_statistics.Paths)
split_tree = SplitTree(Data=number, Masks=flatten(cluster))  # -> Positive, Negative
integer_3 = Integer(split_list.ListA)
end_points = EndPoints(Curve=curve_2)  # -> Start, End
split_tree_2 = SplitTree(Data=ghpython_script_3.element_reaction, Masks=flatten("{*;1}"))  # -> Positive, Negative
split_tree_3 = SplitTree(Data=ghpython_script_3.element_reaction, Masks=flatten("{*;0}"))  # -> Positive, Negative
remove_duplicate_points_karamba3d = RemoveDuplicatePointsKaramba3D(Point=[end_points.Start, end_points.End], LimitDistance=0.005)  # -> OutPoint, Info, Indexes
material_properties_karamba3d = MaterialPropertiesKaramba3D(
    FamilyOfMaterial=panel_17,
    Name="0",
    YoungsModulus_kN_cm2=panel_12,
    InPlaneShearModulus_kN_cm2=panel_13,
    TransverseShearModulus_kN_cm2=panel_13,
    SpecificWeight_kN_m3=panel_21,
    CoefficientOfThermalExpansion_1_C=1e-05,
    YieldStrength_kN_cm2=Slider(23.5, range=0..100),
    mode="Isotrop")
material_properties_karamba3d_2 = MaterialPropertiesKaramba3D(
    FamilyOfMaterial="Steel",
    Name="S235",
    YoungsModulus_kN_cm2=21000,
    InPlaneShearModulus_kN_cm2=8076,
    TransverseShearModulus_kN_cm2=8076,
    SpecificWeight_kN_m3=78.5,
    CoefficientOfThermalExpansion_1_C=1e-05,
    YieldStrength_kN_cm2=23.5,
    mode="Isotrop")
shift_paths = ShiftPaths(Data=split_tree_2.Positive, Offset=-1)
shift_paths_2 = ShiftPaths(Data=split_tree_3.Positive, Offset=-1)
point_2 = Point(remove_duplicate_points_karamba3d.OutPoint)

# ----
# element local axis
panel_23 = Panel("1")
concatenate_4 = Concatenate(B="{", Fragment_A=integer_3, A=";", Fragment_B=panel_23, C="}")
concatenate_5 = Concatenate(B="{", Fragment_A=integer_3, A=";", Fragment_B="0", C="}")
split_tree_4 = SplitTree(Data=split_tree.Positive, Masks=flatten(concatenate_4))  # -> Positive, Negative
split_tree_5 = SplitTree(Data=split_tree.Positive, Masks=flatten(concatenate_5))  # -> Positive, Negative
list_item_2 = ListItem(List=split_tree_4.Positive, Index=0, Wrap=True)  # -> Item, Item1, Item2
list_item_3 = ListItem(List=split_tree_5.Positive, Index=0, Wrap=True)  # -> Item, Item1, Item2
construct_path = ConstructPath(Indices=simplify(graft(integer_3)))  # -> flatten(Branch)
evaluate_curve = EvaluateCurve(Curve=curve_3, Parameter=Slider(0.5, range=0..1))  # -> Point, Tangent, Angle
vector_xyz = VectorXYZ(XComponent=list_item_2.Item, YComponent=list_item_2.Item1, ZComponent=list_item_2.Item2)  # -> simplify(Vector), Length
vector_xyz_2 = VectorXYZ(XComponent=list_item_3.Item, YComponent=list_item_3.Item1, ZComponent=list_item_3.Item2)  # -> simplify(Vector), Length
split_tree_6 = SplitTree(Data=evaluate_curve.Point, Masks=flatten(construct_path))  # -> Positive, Negative
vector = Vector(vector_xyz.Vector)
vector_2 = Vector(vector_xyz_2.Vector)
point_3 = Point(split_tree_6.Positive)
cross_product = CrossProduct(VectorA=vector_2, VectorB=vector, Unitize=True)  # -> Vector, Length
vector_3 = Vector(cross_product.Vector)
colour_rgb = ColourRGB(Alpha=255, Red="256", Green=0, Blue=0)
construct_plane = ConstructPlane(Origin=point_3, XAxis=vector_2, YAxis=vector)
colour_rgb_2 = ColourRGB(Alpha=255, Red=0, Green="256", Blue=0)
colour_rgb_3 = ColourRGB(Alpha=255, Red=0, Green=0, Blue="256")
vector_display_ex = VectorDisplayEx(Point=point_3, Vector=vector_2, Colour=colour_rgb, Width=2)
vector_display_ex_2 = VectorDisplayEx(Point=point_3, Vector=vector, Colour=colour_rgb_2, Width=2)
vector_display_ex_3 = VectorDisplayEx(Point=point_3, Vector=vector_3, Colour=colour_rgb_3, Width=2)

panel_24 = Panel(material_properties_karamba3d)
panel_25 = Panel(material_properties_karamba3d_2)
integer_4 = Integer(ghpython_script_2.fix_node_ids)

# ----
# all nodes
point_4 = Point(point)

list_item_4 = ListItem(List=point_4, Index=integer_4, Wrap=True)
tree_statistics_2 = TreeStatistics(Tree=shift_paths_2)  # -> Paths, Length, Count
curve_4 = Curve(curve_3)
number_2 = Number(shift_paths)
list_item_5 = ListItem(List=shift_paths_2, Index=0, Wrap=True)  # -> Item, Item1, Item2, Item3, Item4, Item5
list_item_6 = ListItem(List=number_2, Index=0, Wrap=True)  # -> Item, Item1, Item2, Item3, Item4, Item5
split_tree_7 = SplitTree(Data=curve_4, Masks=flatten(tree_statistics_2.Paths))  # -> Positive, Negative

# ----
# existing nodes
point_5 = Point(flatten(point_2))

# ----
# existing elements
curve_5 = Curve(flatten(curve_2))

# ----
# element id shower
curve_6 = Curve([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])
entwine = Entwine(Branch00=curve_6, FlattenInputs=True)
c_script = CSharpScript(model=curve_5, layers=entwine)  # -> out, A, edge_layer_list; inputs model: list of Curve, layers: tree of Curve
# ---------- c_script: C# usings ----------
using System.IO;
using System.Linq;
using System.Data;
using System.Drawing;
using System.Reflection;
using System.Windows.Forms;
using System.Xml;
using System.Xml.Linq;
using System.Runtime.InteropServices;

using Rhino.DocObjects;
using Rhino.Collections;
using GH_IO;
using GH_IO.Serialization;
# ---------- c_script: C# ----------
    DataTree<int> index_tree = new DataTree<int>();
    List<int> edge_layer = new List<int>(new int[model.Count()]);

    foreach(var path in layers.Paths)
    {
      foreach(var line in layers.Branch(path.Indices))
      {
        for(int i = 0; i < model.Count(); i++)
        {
          var compare_line = model[i];

          if(line.PointAt(0) == compare_line.PointAt(0))
          {
            if(line.PointAt(1) == compare_line.PointAt(1))
            {
              index_tree.Add(i, path);
              edge_layer[i] = path.Indices[0];
              //              GH_Path p = new GH_Path(0);
              //              p.Indices
              continue;
            }
          }

          if(line.PointAt(0) == compare_line.PointAt(1))
          {
            if(line.PointAt(1) == compare_line.PointAt(0))
            {
              index_tree.Add(i, path);
              edge_layer[i] = path.Indices[0];
              continue;
            }
          }
        }
      }
    }

    A = index_tree;
    edge_layer_list = edge_layer;
# ---------- end c_script ----------

list_item_7 = ListItem(List=curve_5, Index=c_script.A, Wrap=True)
panel_26 = Panel(c_script.A)
ghpython_script_4 = GhPythonScript(x=panel_26)  # -> out, a; inputs x: list
# ---------- ghpython_script_4: Python ----------
__author__ = "harry"
__version__ = "2019.08.22"

import rhinoscriptsyntax as rs

print([int(v) for v in x])
# ---------- end ghpython_script_4 ----------

# ----
# grounded nodes
point_6 = Point(list_item_4)

point_7 = Point(point_5)

# ----
# Point load
point_8 = Point()  # disabled
c_script_2 = CSharpScript(pts=point_7, target_pts=point_8, dist_tol=0.001)  # -> out, A; inputs pts: list of Point3d, target_pts: list of Point3d, dist_tol: Double; disabled
# ---------- c_script_2: C# ----------
    List<int> id = new List<int>();

    foreach(Point3d t_pt in target_pts)
    {
      for(int i = 0; i < pts.Count(); i++)
      {
        if(t_pt.DistanceTo(pts[i]) < dist_tol)
        {
          id.Add(i);
          break;
        }
      }
    }

    A = id;
# ---------- end c_script_2 ----------
integer_5 = Integer(c_script_2.A)  # disabled
panel_27 = Panel("""0.0, 11.125, 0.0
0.0, 11.125, 0.0
222.5, 0, -111.25
222.5, 0, -111.25""")  # disabled
list_item_8 = ListItem(List=point_7, Index=integer_5, Wrap=True)  # disabled
vector_4 = Vector(panel_27)  # disabled
point_9 = Point(list_item_8)  # disabled
panel_28 = Panel(vector_4)  # disabled
vector_display = VectorDisplay(Anchor=point_9, Vector=vector_4)  # disabled
panel_29 = Panel("0")  # disabled
loads_karamba3d = LoadsKaramba3D(ForceVector=vector_4, Local=False, PosInd=point_9, LCase=panel_29, mode="Point")  # -> flatten(Load); disabled

c_script_3 = CSharpScript(pts=point_7, target_pts=point_6, dist_tol=0.001)  # -> out, A; inputs pts: list of Point3d, target_pts: list of Point3d, dist_tol: Double; same code as c_script_2
list_item_9 = ListItem(List=point_7, Index=c_script_3.A, Wrap=True)

# ----
# local z axis
vector_5 = Vector(vector_3)

# ----
# local y axis
vector_6 = Vector(vector)

# ----
# local x axis
vector_7 = Vector(vector_2)

number_3 = Number(panel_22)

# ----
# Supports
point_10 = Point(list_item_9)
support_karamba3d = SupportKaramba3D(PosInd=point_10, menu=[buttons(on, on, on, on, on, on)])
support_karamba3d_2 = SupportKaramba3D(support_karamba3d)

radius_cm = Panel(number_3)

# ----
# Gravity load
unit_z = UnitZ(Factor=1)
negative = Negative(Value=unit_z)
loads_karamba3d_2 = LoadsKaramba3D(Vector=negative, LCase=0, mode="Gravity")

curve_7 = Curve(curve_5)
multiplication = Multiplication(A=number_3, B="2")
vector_8 = Vector(unitize(vector_5))
vector_9 = Vector(unitize(vector_6))
curve_8 = Curve(split_tree_7.Positive)
vector_10 = Vector(vector_5)
curve_9 = Curve(split_tree_7.Positive)
number_4 = Number(list_item_5.Item)
negative_2 = Negative(Value=vector_8)
negative_3 = Negative(Value=vector_9)
curve_10 = Curve(split_tree_7.Positive)
number_5 = Number(list_item_5.Item1)
cross_section_karamba3d = CrossSectionKaramba3D(
    FamilyNameOfCrossSection="DefaultCroSec",
    Material=material_properties_karamba3d,
    Diameter_cm=multiplication,
    WallThickness_cm=number_3,
    mode="Circular Hollow")

# ----
# Vy (shear force along local y axis)
# scaling
number_slider = Slider(0, range=0..1)
c_script_4 = CSharpScript(data_tree=number_5, threshold=number_slider)  # -> out, positive_branches, negative_branches; inputs data_tree: tree of Double, threshold: Double
# ---------- c_script_4: C# ----------
    DataTree<double> data_tree_pos = new DataTree<double>();
    DataTree<double> data_tree_neg = new DataTree<double>();

    foreach(var path in data_tree.Paths)
    {
      double val = data_tree.Branch(path)[0];
      if (val > threshold)
      {
        data_tree_pos.Add(val, path);
      }
      else
      {
        data_tree_neg.Add(val, path);
      }
    }

    negative_branches = data_tree_neg;
    positive_branches = data_tree_pos;
# ---------- end c_script_4 ----------
cluster_2 = Cluster_3(data=curve_10, tree=c_script_4.positive_branches)  # -> positive, negative
cluster_3 = Cluster_3(data=negative_3, tree=c_script_4.positive_branches)  # -> positive, negative
curve_11 = Curve(cluster_2.negative)
curve_12 = Curve(cluster_2.positive)
number_slider_2 = Slider(256, range=0..256)
number_slider_3 = Slider(9.171, range=0..10)
multiplication_2 = Multiplication(A=cluster_3.negative, B=c_script_4.negative_branches)
multiplication_3 = Multiplication(A=cluster_3.positive, B=c_script_4.positive_branches)
multiplication_4 = Multiplication(A=multiplication_3, B=number_slider_3)
multiplication_5 = Multiplication(A=multiplication_2, B=number_slider_3)
colour_rgb_4 = ColourRGB(Alpha=255, Red=0, Green=number_slider_2, Blue=0)
colour_rgb_5 = ColourRGB(Alpha=255, Red=number_slider_2, Green=0, Blue=0)
extrude = Extrude(Base=curve_12, Direction=multiplication_4)
extrude_2 = Extrude(Base=curve_11, Direction=multiplication_5)
colour = Colour(colour_rgb_5)
colour_2 = Colour(colour_rgb_4)
custom_preview = CustomPreview(Geometry=extrude, Material=colour)
custom_preview_2 = CustomPreview(Geometry=extrude_2, Material=colour_2)

point_11 = Point(point_7)
line_to_beam_karamba3d = LineToBeamKaramba3D(Line=curve_7, CrossSection=cross_section_karamba3d, Points=point_11, New=True, Remove=True, LimitDistance_m=0.005)  # -> Element, Points, Info
load_karamba3d = LoadKaramba3D(loads_karamba3d_2)
assemble_model_karamba3d = AssembleModelKaramba3D(
    Point=point_11,
    Elem=line_to_beam_karamba3d.Element,
    Support=support_karamba3d_2,
    Load=load_karamba3d,
    Material=material_properties_karamba3d,
    LimitDistance_m=0.005)  # -> Model, Info, Mass_kg, CenterOfGravity
analyze_karamba3d = AnalyzeKaramba3D(Model=assemble_model_karamba3d.Model)  # -> CalculatedModel, MaximumDisplacement_cm, ResultingForceOfGravity_kN, ElasticEnergy_kNm
model_view_karamba3d = ModelViewKaramba3D(Model=analyze_karamba3d.CalculatedModel, LoadCaseFactorsForLinearSuperposition=1, IndexOfVisibleLoadcase=-1)  # -> Model, DeformedMesh, DeformedAxes, DeformedModel
beam_view_karamba3d = BeamViewKaramba3D(Model=model_view_karamba3d.Model)  # -> Model, MeshesOfRenderedBeams, DeformedBeamAxes, LegendColors, LegendTags
legend = Legend(Colour=beam_view_karamba3d.LegendColors, Tags=beam_view_karamba3d.LegendTags, LegendType=1)

# ----
# scaling
number_slider_4 = Slider(0.392, range=0..5)

# ----
# Nx (axial force)
# at node 0,
# force > 0 tension
# force < 0 compression
number_slider_5 = Slider(0, range=0..1)
c_script_5 = CSharpScript(data_tree=number_4, threshold=number_slider_5)  # -> out, positive_branches, negative_branches; inputs data_tree: tree of Double, threshold: Double; same code as c_script_4
cluster_4 = Cluster_2(data=curve_9, tree=c_script_5.positive_branches)  # -> positive, negative
cluster_5 = Cluster_3(data=negative_2, tree=c_script_5.positive_branches)  # -> positive, negative
curve_13 = Curve(cluster_4.negative)
curve_14 = Curve(cluster_4.positive)
number_slider_6 = Slider(256, range=0..256)
multiplication_6 = Multiplication(A=cluster_5.negative, B=c_script_5.negative_branches)
multiplication_7 = Multiplication(A=cluster_5.positive, B=c_script_5.positive_branches)
multiplication_8 = Multiplication(A=multiplication_7, B=number_slider_4)
multiplication_9 = Multiplication(A=multiplication_6, B=number_slider_4)
colour_rgb_6 = ColourRGB(Alpha=255, Red=number_slider_6, Green=0, Blue=0)
colour_rgb_7 = ColourRGB(Alpha=255, Red=0, Green=0, Blue=number_slider_6)
extrude_3 = Extrude(Base=curve_14, Direction=multiplication_8)
extrude_4 = Extrude(Base=curve_13, Direction=multiplication_9)
colour_3 = Colour(colour_rgb_7)
colour_4 = Colour(colour_rgb_6)
custom_preview_3 = CustomPreview(Geometry=extrude_3, Material=colour_3)
custom_preview_4 = CustomPreview(Geometry=extrude_4, Material=colour_4)

reaction_forces_karamba3d = ReactionForcesKaramba3D(AnalyzedModel=analyze_karamba3d.CalculatedModel, LoadCase=0)  # -> AnalyzedModel, ReactionForces_kN, ReactionMoments_kNm, SupportPosition, SumOfReactionForces_kN, SumOfReactionMoments_kNm
nodal_displacements_karamba3d = NodalDisplacementsKaramba3D(AnalyzedModel=analyze_karamba3d.CalculatedModel, LoadCase=0)  # -> AnalyzedModel, NodalTranslations_m, NodalRotations_rad
beam_forces_karamba3d = BeamForcesKaramba3D(
    AnalyzedModel=analyze_karamba3d.CalculatedModel,
    LCase=-1,
    MaximumDistanceBetweenResults_m=-1,
    NumberOfResultsPerBeamElement=2)  # -> AnalyzedModel, NormalForce_kN, ShearForceVz_kN, ShearForceVy_kN, BendingMomentMt_kNm, BendingMomentMy_kNm, BendingMomentMz_kNm
panel_30 = Panel(multiplication_5)
deconstruct = Deconstruct(Point=simplify(graft(reaction_forces_karamba3d.ReactionForces_kN)))  # -> XComponent, YComponent, ZComponent
deconstruct_2 = Deconstruct(Point=simplify(graft(reaction_forces_karamba3d.ReactionMoments_kNm)))  # -> XComponent, YComponent, ZComponent
merge = Merge(
    Data1=simplify(graft(nodal_displacements_karamba3d.NodalTranslations_m)),
    Data2=simplify(graft(nodal_displacements_karamba3d.NodalRotations_rad)))

# ----
# scaling
number_slider_7 = Slider(37.617, range=0..70)

# ----
# My
# https://mechanicalc.com/reference/beam-deflection-tables
vector_11 = Vector(unitize(vector_10))
negative_4 = Negative(Value=vector_11)
number_slider_8 = Slider(81, range=0..100)
curve_15 = Curve(curve_8)
subtraction_2 = Subtraction(A=number_slider_8, B="0")
curve_16 = Curve(curve_15)
number_slider_9 = Slider(256, range=0..256)
divide_curve = DivideCurve(Curve=curve_16, Count=subtraction_2, Kinks=False)  # -> Points, Tangents, Parameters
shatter = Shatter(Curve=curve_16, Parameters=divide_curve.Parameters)  # -> simplify(Segments)
colour_rgb_8 = ColourRGB(Alpha=255, Red=0, Green=number_slider_9, Blue=0)
colour_rgb_9 = ColourRGB(Alpha=255, Red=number_slider_9, Green=0, Blue=0)
colour_5 = Colour(colour_rgb_9)
colour_6 = Colour(colour_rgb_8)
curve_17 = Curve(curve_3)
length = Length(Curve=curve_17)
number_6 = Number(list_item_5.Item4)
number_7 = Number(list_item_6.Item4)
ghpython_script_5 = GhPythonScript(beam_end_moment_0=number_6, beam_end_moment_1=number_7, e_len=length, disc=number_slider_8)  # -> out, simplify(moment_crv_pt_coord); inputs disc: Int32
# ---------- ghpython_script_5: Python ----------
__author__ = "harry"
__version__ = "2019.08.28"

import rhinoscriptsyntax as rs

assert beam_end_moment_0 == beam_end_moment_1

w = beam_end_moment_0 * (-12) / (e_len**2)

def compute_moment(x):
    return (w / 12.0) * (6*e_len*x - 6*x**2 - e_len**2)

moment_crv_pt_coord = []
for i in range(disc):
    moment_crv_pt_coord.append(compute_moment(i * (e_len/disc)))
# ---------- end ghpython_script_5 ----------
multiplication_10 = Multiplication(A=vector_11, B=ghpython_script_5.moment_crv_pt_coord)
panel_31 = Panel(ghpython_script_5.moment_crv_pt_coord)
multiplication_11 = Multiplication(A=multiplication_10, B=number_slider_7)
curve_18 = Curve(shatter)
extrude_5 = Extrude(Base=curve_18, Direction=multiplication_11)
custom_preview_5 = CustomPreview(Geometry=extrude_5, Material=colour_5)

evaluate = Evaluate(Expression="format(\"{0:E} {1:E} {2:E}\",x.x,x.y,x.z)", x=merge)
merge_2 = Merge(
    Data1=deconstruct.XComponent,
    Data2=deconstruct.YComponent,
    Data3=deconstruct.ZComponent,
    Data4=deconstruct_2.XComponent,
    Data5=deconstruct_2.YComponent,
    Data6=deconstruct_2.ZComponent)
merge_3 = Merge(
    Data1=graft(beam_forces_karamba3d.NormalForce_kN),
    Data2=graft(beam_forces_karamba3d.ShearForceVz_kN),
    Data3=graft(beam_forces_karamba3d.ShearForceVy_kN),
    Data4=graft(beam_forces_karamba3d.BendingMomentMt_kNm),
    Data5=graft(beam_forces_karamba3d.BendingMomentMy_kNm),
    Data6=graft(beam_forces_karamba3d.BendingMomentMz_kNm))  # -> simplify(Result)
evaluate_2 = Evaluate(Expression="format(\"{0:E}\",x)", x=merge_2)
cluster_6 = Cluster(text=evaluate, separators=" ")
evaluate_3 = Evaluate(Expression="format(\"{0:E}\",x)", x=merge_3)
reaction_force_kn_reaction_moment_kn_m = Panel(merge_2)
shift_paths_3 = ShiftPaths(Data=cluster_6, Offset=-1)

froce_kn_moment_kn_m = Panel(merge_3)
panel_32 = Panel(ghpython_script_3.element_reaction)
panel_33 = Panel(ghpython_script_3.fixities_reaction)
nodal_displacement_m_rad = Panel(shift_paths_3)
panel_34 = Panel(ghpython_script_3.node_displacement)

list_item_10 = ListItem(List=shift_paths_3, Index=0, Wrap=True)  # -> Item, Item1, Item2
merge_4 = Merge(Data1=list_item_10.Item, Data2=list_item_10.Item1, Data3=list_item_10.Item2)
number_8 = Number(merge_4)
square = Square(Value=number_8)
mass_addition_3 = MassAddition(Input=square)  # -> Result, PartialResults
square_root = SquareRoot(Value=mass_addition_3.Result)  # -> flatten(Result)
sort_list = SortList(Keys=square_root)  # -> reverse(Keys), ValuesA
max_deformation_l2_on_trans = Panel(sort_list.Keys)

# ==== cluster Cluster
text = ClusterInput()
separators = ClusterInput()
text_split = TextSplit(Text=text, Separators=separators)
number = Number(text_split)
clean_tree = CleanTree(RemoveNulls=True, RemoveInvalid=True, RemoveEmpty=False, Tree=number)
tree = ClusterOutput(clean_tree)

# ==== cluster Cluster_2
tree = ClusterInput()
data = ClusterInput()
tree_statistics = TreeStatistics(Tree=tree)  # -> Paths, Length, Count
split_tree = SplitTree(Data=data, Masks=flatten(tree_statistics.Paths))  # -> Positive, Negative
positive = ClusterOutput(split_tree.Positive)
negative = ClusterOutput(split_tree.Negative)

# ==== cluster Cluster_3
tree = ClusterInput()
tree_statistics = TreeStatistics(Tree=tree)  # -> Paths, Length, Count
data = ClusterInput()
split_tree = SplitTree(Data=data, Masks=flatten(tree_statistics.Paths))  # -> Positive, Negative
positive = ClusterOutput(split_tree.Positive)
negative = ClusterOutput(split_tree.Negative)

# ==== cluster Cluster_4
branch = ClusterInput()
deconstruct_path = DeconstructPath(Branch=branch)
concatenate = Concatenate(A="{", Fragment_A=deconstruct_path, B=";", Fragment_B="*", C="}")  # -> flatten(Result)
result = ClusterOutput(concatenate)
